# Grasshopper definition gHowl_getTerrain.gh (Grasshopper 0.8.51)

# ---- group: Switch These Locations
location = ValueList(
    {"Boulder, CO, USA": 0, "Emeishan, Sicuan, P.R.C": 1, "Somewhere in the Himalayas": 2, "Near Mont Blanc": 3}, selected=[],
    ListIndex=3,
    UIMode=1)

# ----
slider = Slider(33, range=0..50)

# ---- group: Ref Pt
panel = Panel("{-105.283419, 39.955121,0}")
pt = Point(<point referenced from the Rhino model>)

panel_2 = Panel("{7.011558,45.913582,0}")
pt_2 = Point(<point referenced from the Rhino model>)

panel_3 = Panel("{103.467287, 29.585666,0}")
pt_3 = Point(<point referenced from the Rhino model>)

panel_4 = Panel("{102.935927, 29.394700,0}")
pt_4 = Point(<point referenced from the Rhino model>)

# ----
geo_ref = StreamFilter(Gate=location, Stream0=panel, Stream1=panel_3, Stream2=panel_4, Stream3=panel_2)
xyz_ref = StreamFilter(Gate=location, Stream0=pt, Stream1=pt_3, Stream2=pt_4, Stream3=pt_2)

panel_5 = Panel("Emeishan, Sichuan, China")
srf = Surface(<surface referenced from the Rhino model>)

tag = TextTag3D(Location=pt_3, Text=panel_5, Size=100)

# ----
# Get Elevation
# This definition takes a set of WSG84 formatted points (Longitude, Latitude, 0) and returns the altitude.  It queries the Google Elevations API (http://code.google.com/apis/maps/documentation/elevation/)
# 
# LIMITATIONS:
# Use of the Google Elevation API is subject to a limit of 2,500 requests per day. In each given request you may query the elevation of up to 512 locations, but you may not exceed 25,000 total locations per day. This limit is enforced to prevent abuse and/or repurposing of the Elevation API, and this limit may be changed in the future without notice. Additionally, we enforce a request rate limit to prevent abuse of the service. If you exceed the 24-hour limit or otherwise abuse the service, the Elevation API may stop working for you temporarily. If you continue to exceed this limit, your access to the Elevation API may be blocked.
# The Elevation API returns data for single point queries of the highest accuracy possible. Batch queries involving multiple locations may return data with less accuracy, especially if the locations are spread apart, as some smoothing of data occurs.
# 
# REQUIREMENTS:
# rhino file: cph_file.3dgHowlTerrain.3dm
# 
# ==================================================
# gHowl is a set of components which extend Grasshopper's ability to communicate and exchange information with other applications and physical devices.
# 
# Keep up with the latest developments of gHowl on the
# gHowl group on grasshopper3d.com:
# http://www.grasshopper3d.com/group/ghowl
# 
# gHowl is developed by:
# Damien Alomar: http://www.liquidtectonics.com
# Luis E. Fraguada: http://www.livearchitecture.net
# Giulio Piacentino: http://www.giuliopiacentino.com
panel_6 = Panel("Boulder, Co, USA")
srf_2 = Surface(<surface referenced from the Rhino model>)

tag_2 = TextTag3D(Location=pt, Text=panel_6, Size=100)

panel_7 = Panel("Somewhere in the Himalayas")
srf_3 = Surface(<surface referenced from the Rhino model>)

tag_3 = TextTag3D(Location=pt_4, Text=panel_7, Size=100)

srf_4 = Surface(<surface referenced from the Rhino model>)

srf_5 = StreamFilter(Gate=location, Stream0=srf_2, Stream1=srf, Stream2=srf_3, Stream3=srf_4)
loc = StreamFilter(Gate=location, Stream0=panel_6, Stream1=panel_5, Stream2=panel_7, Stream3="Near Mont Blanc")
sdivide = DivideSurface(Surface=reparameterize(srf_5), UCount=slider, VCount=slider)  # -> Points, Normals, Parameters
panel_8 = Panel(loc)
tag_4 = TextTag3D(Location=pt_2, Text="Near Mont Blanc", Size=100)

image = ImageSampler(
    flatten(sdivide.Parameters),
    FilePath="C:\Users\Luis E. Fraguada\Desktop\gHowl\getTerrain2\Emeishan1.jpg",
    RelativeFilePath="..\..\..\..\getTerrain2\Emeishan1.jpg",
    Interpolate=False,
    Wrap=1,
    Umin=0,
    Umax=1,
    Vmin=0,
    Vmax=1,
    Filter="Colour")

image_2 = ImageSampler(
    flatten(sdivide.Parameters),
    FilePath="C:\Users\Luis E. Fraguada\Desktop\gHowl\getTerrain2\him.jpg",
    RelativeFilePath="..\..\..\..\getTerrain2\him.jpg",
    Interpolate=False,
    Wrap=1,
    Umin=0,
    Umax=1,
    Vmin=0,
    Vmax=1,
    Filter="Colour")

image_3 = ImageSampler(
    flatten(sdivide.Parameters),
    FilePath="C:\Users\Luis E. Fraguada\Desktop\gHowl\getTerrain2\boulder.jpg",
    RelativeFilePath="..\..\..\..\getTerrain2\boulder.jpg",
    Interpolate=True,
    Wrap=1,
    Umin=0,
    Umax=1,
    Vmin=0,
    Vmax=1,
    Filter="Colour")

image_4 = ImageSampler(
    flatten(sdivide.Parameters),
    FilePath="C:\Users\Luis E. Fraguada\Desktop\gHowl\getTerrain2\montblanc.jpg",
    RelativeFilePath="..\..\..\..\getTerrain2\montblanc.jpg",
    Interpolate=False,
    Wrap=1,
    Umin=0,
    Umax=1,
    Vmin=0,
    Vmax=1,
    Filter="Colour")

img = StreamFilter(Gate=location, Stream0=image_3, Stream1=image, Stream2=image_2, Stream3=image_4)
pcomp = Decompose(Point=sdivide.Points)  # -> XComponent, YComponent, ZComponent
xyz_geo = XYZToGeo(XYZ_IN=flatten(sdivide.Points), EAP_XYZ=xyz_ref, EAP_Geo=geo_ref)
E = GetElevation(GeoPoints=xyz_geo)
pt_5 = PointXYZ(XComponent=flatten(pcomp.XComponent), YComponent=flatten(pcomp.YComponent), ZComponent=flatten(E))
del = DelaunayMesh(Points=pt_5, Plane=PlaneXY(0, 0, 0))
mcomp = Decompose(Mesh=del)  # -> Vertices, Faces, Colours, Normals
msmooth = SmoothMesh(Mesh=del, Strength=0.5, SkipNaked=True, Iterations=1)
mesh = Mesh(Vertices=mcomp.Vertices, Faces=mcomp.Faces, Colours=img)
bbox = BoundingBox(Content=msmooth, Union=False, Plane=PlaneXY(0, 0, 0))  # -> Box, Box_2
wires = BrepWireframe(Brep=bbox.Box, Density=-1)
item = ListItem(List=wires, Index=10, Wrap=False)
divlength = DivideLength(Curve=item, Length=10)  # -> Points, Tangents, Parameters
xy = XYPlane(Origin=divlength.Points)
sec = MeshPlane(Mesh=msmooth, Plane=xy)
preview = CustomPreview(Geometry=sec, Shader=ColourSwatch(SwatchColor=RGB(0, 0, 0)))
