# Grasshopper definition gHowl_KML.ghx (Grasshopper 0.8.51)

extrusion = Slider(22.688, range=0..50)
crv = Curve([<curve referenced from the Rhino model> x3])
Z = UnitZ(Factor=extrusion)
planar = PlanarSrf(Edges=crv)
area = BrepArea(Brep=crv)  # -> Area, Centroid
custom_mesh_settings = SettingsCustom(
    StitchSeams=True,
    SimplePlanes=True,
    Refine=True,
    MinCount=16,
    MaxCount=400,
    AspectRatio=20,
    MaxDistance=0,
    MaxAngle=20,
    MinEdge=0,
    MaxEdge=0)
extr = Extrude(Base=planar, Direction=Z)

# ---- group: Edit this path to a location on your system
path = Panel("c:\data\gHowlGeometry.kml")

# ----
mesh = MeshBrep(Brep=extr, Settings=custom_mesh_settings)
refpt1_geo = Panel("{12.575636, 55.675648, 0}")
list = ValueList({"absolute", "clampToGround", "relativeToGround"}, selected=[], ListIndex=2, UIMode=1)
refpt1_x_y_z = Point(<point referenced from the Rhino model>)
pt = Point(area.Centroid)
crv_2 = Curve(crv)
mesh_2 = Mesh(mesh)
# KML Exporter
# This definition demonstrates the functionality of the KML export component.  At the moment one can export Points, Curves, and Meshes.  Breps should be meshed prior to exporting.  Brep support will be added in the future.  Currently there is no support for object attributes such as color, transparency, line color, line width, or custom notes.  We plan to add all of this in the near future.
# 
# Usage: The KML exporter will make a file on your system.  You can use this file in Google Earth two ways:
# 1. in google earth go to File > Open
# 2. in google earth go to Add > Network Link
# -Change the Refresh rate in 'Time-Based Refresh' to 'Periodically.' You will be able to chose the refresh rate, though the fastest at the moment is once per second.
# -Once this Network Link is established, anything you change in the GH file will update in Google Earth.
# 
# Note:  Make sure to edit the path where you want to save the KML file.
# 
# REQUIREMENTS:
# rhino file: cph_file.3dm
# 
# ==================================================
# gHowl is a set of components which extend Grasshopper's ability to communicate and exchange information with other applications and physical devices.
# 
# Keep up with the latest developments of gHowl on the
# gHowl group on grasshopper3d.com:
# http://www.grasshopper3d.com/group/ghowl
# 
# gHowl is developed by:
# Damien Alomar: http://www.liquidtectonics.com
# Luis E. Fraguada: http://www.livearchitecture.net
# Giulio Piacentino: http://www.giuliopiacentino.com
S = KMLStyle(FillColor=ColourSwatch(SwatchColor=RGB(255, 0, 0)), CurveColor=ColourSwatch(SwatchColor=RGB(0, 0, 0)), CurveWidth=1)
kml_out = KMLExporter(FilePath=path, Geometry=[pt, crv_2, mesh_2], Style=S, EAP_XYZ=refpt1_x_y_z, EAP_GPS=refpt1_geo, AltitudeMode=list)
