# Grasshopper definition Unity-GH-UDP.gh (Grasshopper 0.9.76)
# plug-ins: gHowl

# ---- group: receive the message from Unity
# Geometry transfer between Unity and Grasshopper via UDP
# 
# for more info check the blog at:
# www.aware-studio.com
ip_to_receive_on_this_computer = Panel("192.168.0.11")
port_to_receive_on = Panel("8051")
udp = UDPReceiver(Address=ip_to_receive_on_this_computer, Port=port_to_receive_on, Pattern=0)  # -> Info, Data
panel = Panel(udp.Info)

# ----
# RECEIVE FROM UNITY
the_message_coming_from_unity = Panel(udp.Data)

# ---- group: parse the message
split = TextSplit(Text=udp.Data, Separators=";")
rep = ReplaceText(Text=split, Find="(", Replace="{", RecursiveReplace=False)
rep_2 = ReplaceText(Text=rep, Find=")", Replace="}", RecursiveReplace=False)

# ----
c_script = CSharpScript(x=rep_2)  # -> out, A; inputs x: Vector3d
# ---------- c_script: C# ----------
    A = new Vector3d (x.X, x.Z, x.Y);
# ---------- end c_script ----------

# ---- group: parse the message (continued)
pt = Point(c_script.A)

# ---- group: reconstruct the Geometry in GH
item = ListItem(List=pt, Index=1, Wrap=True)
pdecon = Deconstruct(Point=item)  # -> XComponent, YComponent, ZComponent
item_2 = ListItem(List=pt, Index=0, Wrap=True)
division = Division(A=pdecon.ZComponent, B="2")
division_2 = Division(A=pdecon.XComponent, B="2")
division_3 = Division(A=pdecon.YComponent, B="2")
dom = ConstructDomain(DomainStart=expr("-x", division), DomainEnd=division)
dom_2 = ConstructDomain(DomainStart=expr("-x", division_2), DomainEnd=division_2)
dom_3 = ConstructDomain(DomainStart=expr("-x", division_3), DomainEnd=division_3)
item_3 = ListItem(List=pt, Index=2, Wrap=True)
box = DomainBox(Base=item_2, X=dom_2, Y=dom_3, Z=dom)

# ----
# in this case the data is
# 0. position of hovered box (xyz)
# 1. sizes of hovered box (xyz)
# 2. hit positon of mouse cursor over the box (xyz)
the_data_as_vectors = Panel(pt)

# ---- group: preview of the box
material = CreateMaterial(
    Diffuse=ColourSwatch(SwatchColor=RGB(0, 255, 255)),
    Specular=RGB(255, 255, 255),
    Emission=RGB(0, 0, 0),
    Transparency=0,
    Shine=0)
wires = BrepWireframe(Brep=box, Density=-1)
# Geometry Postprocessing:
# In the case of this example we use the
# point where the mouse is to split the box
# in 4 smaller boxes each with 25% of the
# volume of the original box
preview = CustomPreview(Geometry=wires, Shader=material)

# ---- group: do something to the geometry
volume = Volume(Geometry=box)  # -> Volume, Centroid
debrep = DeconstructBrep(Brep=box)  # -> Faces, Edges, Vertices
srf_cp = SurfaceClosestPoint(Point=item_3, Surface=reparameterize(debrep.Faces))  # -> Point, UVPoint, Distance
vb = VBScript(x=srf_cp.UVPoint)  # -> out, A; inputs x: Point3d
# ---------- vb: VB ----------
    If x.x <> 0 And x.X <> 1 And x.Y <> 0 And x.Y <> 1 Then
      A = True
    Else 
      a = false
    End If
# ---------- end vb ----------
cull = CullPattern(List=srf_cp.Point, CullPattern=vb.A)
# POST-PROCESS INPUT
number_slider = Slider(0.5, range=0..1)
pline = PolyLine(Vertices=cull, Closed=False)
pframe = PerpFrame(Curve=pline, Parameter=number_slider)
sec = BrepPlane(Brep=box, Plane=pframe)  # -> Curves, Points
cp = ControlPoints(Curve=sec.Curves)  # -> Points, Weights, Knots
curvepoint = PointOnCurve(pline, parameter=0.5)
shift = ShiftList(List=cp.Points, Shift=1, Wrap=False)
plcoord = PlaneCoordinates(Point=shift, System=pframe)  # -> XCoordinate, YCoordinate, ZCoordinate
ln = Line(StartPoint=shift, EndPoint=curvepoint)
curvepoint_2 = PointOnCurve(ln, parameter=0.5)
num = Number(plcoord.XCoordinate)
num_2 = Number(plcoord.YCoordinate)
pl_origin = PlaneOrigin(Base=pframe, Origin=curvepoint_2)
expression = Expression(x=num_2, Expression="abs(x)/2")
expression_2 = Expression(x=num, y=num_2, vol=volume.Volume, Expression="vol/abs(x)/abs(y)/8")
expression_3 = Expression(x=num, Expression="abs(x)/2")
panel_2 = Panel(num_2)
panel_3 = Panel(num)
vb_2 = VBScript(x=expression_2)  # -> out, A
# ---------- vb_2: VB ----------
    If x > 10 Then
      A = 10
    Else
      A = x
    End If
# ---------- end vb_2 ----------
panel_4 = Panel(expression_2)
box_2 = CenterBox(Base=pl_origin, X=expression_3, Y=expression, Z=vb_2.A)

# ---- group: preview of the 4 new boxes
material_2 = CreateMaterial(
    Diffuse=ColourSwatch(SwatchColor=RGB(67, 167, 255)),
    Specular=RGB(255, 255, 255),
    Emission=RGB(0, 0, 0),
    Transparency=0,
    Shine=0)
# Geometry encoding as text:
# Knowing what you want to send to Unity,
# get its parameters and put them in a
# string so you can reconstruct it in
# Unity from the parameters.
# In this case we send the position
# coordinates and sizes of the for
# new boxes as numbers.
preview_2 = CustomPreview(Geometry=box_2, Shader=material_2)

# ---- group: convert the new geometry to string message
bbox = BoundingBox(Content=box_2, Plane=PlaneXY(0, 0, 0))  # -> Box, Box_2
# SEND TO UNITY
boxprop = BoxProperties(Box=box_2)  # -> Center, Diagonal, Area, Volume, Degeneracy
debox = DeconstructBox(Box=bbox.Box)  # -> Plane, X, Y, Z
num_3 = Number(debox.Z)
num_4 = Number(debox.X)
num_5 = Number(debox.Y)
vec = VectorXYZ(XComponent=num_4, YComponent=num_5, ZComponent=num_3)  # -> Vector, Length
vec_2 = Vector(boxprop.Center)

# ----
c_script_2 = CSharpScript(x=vec_2)  # -> out, A; inputs x: Vector3d; same code as c_script
c_script_3 = CSharpScript(x=vec.Vector)  # -> out, A; inputs x: Vector3d; same code as c_script

# ---- group: convert the new geometry to string message (continued)
c_script_4 = CSharpScript(x=c_script_3.A, y=c_script_2.A)  # -> out, A; inputs x: list of Vector3d, y: list of Vector3d
# ---------- c_script_4: C# ----------
    string tmp = "";
    for (int i = 0;i < x.Count; i++){
      tmp = tmp + x[i].ToString() + ";";
    }
    for (int i = 0;i < y.Count; i++){
      tmp = tmp + y[i].ToString() + ";";
    }
    A = tmp.Remove(tmp.Length - 1);
# ---------- end c_script_4 ----------

# ---- group: send message to Unity
ip_to_send_to = Panel("192.168.0.10")
port_to_send_to = Panel("8050")
the_message_being_sent_to_unity = Panel(c_script_4.A)
udp_2 = UDPSender(Address=ip_to_send_to, Port=port_to_send_to, Pattern=0, Data=c_script_4.A)
panel_5 = Panel(udp_2)
