# Grasshopper definition anemone-examples.gh (Grasshopper 0.9.76)
# plug-ins: Anemone

# ---- group: 1st Anemone Example: Simple addition loop
number_slider = Slider(9, range=0..10)
loop_start = LoopStart(Repeat=number_slider, Trigger=number_slider, Data=Slider(0, range=0..10))  # -> port, Counter, Data
addition = Addition(A=loop_start.Data, B=Slider(1, range=0..10))
loop_end = LoopEnd(port=loop_start.port, Exit=False, Data=addition, pausedState=False, state="Constant & Record", TimeOutVal=0)
panel = Panel(loop_end)

# ---- group: 2nd Anemone Example
panel_2 = Panel("""{0, 0, 1}
{0, 0, 2}
{0, 0, 3}""")
c_script = CSharpScript(list=panel_2)  # -> listlength; inputs list: list
# ---------- c_script: C# ----------
    listlength = list.Count - 1;
# ---------- end c_script ----------
loop_start_2 = LoopStart(Repeat=c_script, Data=Slider(0, range=0..10))  # -> port, Counter, Data

# ---- group: 2nd Anemone Example / Add value to vector at list item[i]
item = ListItem(List=panel_2, Index=loop_start_2.Data, Wrap=True)
devec = DeconstructVector(Vector=item)  # -> XComponent, YComponent, ZComponent
addition_2 = Addition(A=devec.ZComponent, B=Slider(1, range=0..5))
pt = ConstructPoint(XCoordinate=devec.XComponent, YCoordinate=devec.YComponent, ZCoordinate=addition_2)

# ---- group: 2nd Anemone Example (continued)
loop_end_2 = LoopEnd(port=loop_start_2.port, Exit=False, Data=pt, pausedState=False, state="Constant & Record", TimeOutVal=0)
browse = BrowseHistory(Iteration=Slider(0, range=0..10), Data_0=loop_end_2)
panel_3 = Panel(browse)
panel_4 = Panel(loop_end_2)
