# Grasshopper definition braid-circle-example.gh (Grasshopper 0.9.76)
# plug-ins: Python Interpreter, Human, Kangaroo2 Components

number_of_levels = Slider(8, range=0..24)
number_of_yarns = Slider(12, range=0..20)
pt = ConstructPoint(XCoordinate=0, YCoordinate=0, ZCoordinate=0)
division = Division(A=number_of_yarns, B=2)
Z = UnitZ(Factor=Slider(439, range=0..1000))
move = Move(Geometry=pt, Motion=Z)  # -> Geometry, Transform
c_script = CSharpScript(x=Slider(10, range=0..10), y=Slider(10, range=0..10), z=Slider(10, range=0..10))  # -> out, A
# ---------- c_script: C# ----------
    Point3d pt = new Point3d(0,5,0);
    
    Print("Hello World");

    
    A = pt;
# ---------- end c_script ----------
python = PythonScript(x=Slider(10, range=0..10), y=Slider(10, range=0..10), z=Slider(10, range=0..10))  # -> out, a
# ---------- python: Python ----------
import Rhino.Geometry as rg

pt = rg.Point3d(x,y,z)
# ---------- end python ----------
series = Series(Start=0, Step=1, Count=division)
panel = Panel(series)
panel_2 = Panel(c_script.out)
ln = Line(StartPoint=pt, EndPoint=move.Geometry)
panel_3 = Panel(c_script.A)
divide = DivideCurve(Curve=ln, Count=number_of_levels, Kinks=False)  # -> Points, Tangents, Parameters
series_2 = Series(Start=series, Step=1, Count=expr("x+1", number_of_levels))
cir = Circle(Plane=divide.Points, Radius=Slider(33, range=0..100))
panel_4 = Panel(series_2)
divide_2 = DivideCurve(Curve=cir, Count=division, Kinks=False)  # -> simplify(Points), Tangents, Parameters
rev = ReverseList(List=series_2)
points = PointList(Points=divide_2.Points, Size=Slider(6, range=0..10))
tstat = TreeStatistics(Tree=divide_2.Points)  # -> Paths, Length, Count
number_slider = Slider(10, range=0..10)
item = TreeItem(Tree=divide_2.Points, Path=tstat.Paths, Index=series_2, Wrap=True)
item_2 = TreeItem(Tree=divide_2.Points, Path=tstat.Paths, Index=rev, Wrap=True)
pline = PolyLine(Vertices=divide_2.Points, Closed=True)
points_2 = PointList(Points=divide_2.Points, Size=number_slider)
points_3 = PointList(Points=item, Size=number_slider)
polygon = Polygon(Plane=pt, Radius=Slider(23, range=0..200), Segments=3, FilletRadius=0)  # -> Polygon, Length
pline_2 = PolyLine(Vertices=item, Closed=False)  # -> flatten(Polyline)
pline_3 = PolyLine(Vertices=item_2, Closed=False)  # -> flatten(Polyline)
disc = Discontinuity(Curve=polygon.Polygon, Level=1)  # -> graft(Points), Parameters
flip = FlipMatrix(Data=item)
pline_4 = PolyLine(Vertices=flip, Closed=True)  # -> flatten(Polyline)
vb = VBScript()  # -> Out, A
merge = Merge(Data1=pline_2, Data2=pline_3)
python_2 = PythonScript()  # -> Out, A
explode = Explode(Curve=merge, Recursive=True)  # -> Segments, Vertices
flip_2 = FlipMatrix(Data=explode.Segments)
explode_2 = Explode(Curve=merge, Recursive=True)  # -> Segments, Vertices
explode_3 = Explode(Curve=pline_4, Recursive=True)  # -> Segments, Vertices
end = EndPoints(Curve=merge)  # -> Start, End
cp = ClosestPoint(Point=disc.Points, Cloud=end.End)  # -> ClosestPoint, CPIndex, Distance
shatter = Shatter(Curve=reparameterize(explode_2.Segments), Parameters=0.5)
join = JoinCurves(Curves=flip_2, Preserve=False)
ln_2 = Line(StartPoint=cp.ClosestPoint, EndPoint=disc.Points)  # -> flatten(Line)
explode_4 = Explode(Curve=join, Recursive=True)  # -> simplify(Segments), Vertices
pshift = ShiftPaths(Data=shatter, Offset=-1)
end_2 = EndPoints(Curve=pshift)  # -> Start, End
cospherical = CoSpherical(Strength=1)
data = Data(flatten([end_2.Start, end_2.End]))
item_3 = ListItem(List=ln_2, Index=0, Wrap=True)  # -> Item, Item1, Item2
shift = ShiftList(List=pshift, Shift=1, Wrap=True)
number_slider_2 = Slider(347, range=0..1000)
shift_2 = ShiftList(List=explode_4.Segments, Shift=1, Wrap=True)
shift_3 = ShiftList(List=explode_3.Segments, Shift=1, Wrap=True)
len = Length(Curve=explode_3.Segments)
len_2 = Length(Curve=item_3.Item)
len_3 = Length(Curve=item_3.Item1)
len_4 = Length(Curve=item_3.Item2)
multiplication = Multiplication(A=len, B=Slider(1, range=0..1))
Z_2 = UnitZ(Factor=Slider(0, range=-10..0))
multiplication_2 = Multiplication(A=len_2, B=Slider(1, range=0..1))
multiplication_3 = Multiplication(A=len_3, B=Slider(1, range=0..1))
Z_3 = UnitZ(Factor=Slider(-0.042, range=-0.1..0))
multiplication_4 = Multiplication(A=len_4, B=Slider(1, range=0..1))
angle = Angle(LineA=explode_4.Segments, LineB=shift_2, Strength=Slider(1000, range=0..1000))
angle_2 = Angle(LineA=explode_3.Segments, LineB=shift_3, Strength=Slider(1000, range=0..1000))
angle_3 = Angle(LineA=pshift, LineB=shift, RestAngle="0", Strength=Slider(304, range=0..1000))
length_line = LengthLine(Line=pshift, Strength=number_slider_2)
length_line_2 = LengthLine(Line=explode_3.Segments, Length=multiplication, Strength=number_slider_2)  # disabled
anchor = Anchor(Point=end.Start, Strength=1000)
load = Load(Point=end.End, ForceVector=Z_2)  # disabled
load_2 = Load(ForceVector=Z_3)
anchor_2 = Anchor(Point=disc.Points, Strength=1000)
length_line_3 = LengthLine(Line=item_3.Item, Length=multiplication_2, Strength=10)
length_line_4 = LengthLine(Line=item_3.Item1, Length=multiplication_3, Strength=10)
length_line_5 = LengthLine(Line=item_3.Item2, Length=multiplication_4, Strength=10)
entwine = Entwine(
    Branch00=length_line,
    Branch01=length_line_2,
    Branch02=angle_3,
    Branch03=angle,
    Branch04=anchor,
    Branch05=load_2,
    Branch06=load,
    Branch07=length_line_3,
    Branch08=length_line_4,
    Branch09=length_line_5,
    Branch010=anchor_2,
    FlattenInputs=True)
solver = Solver(GoalObjects=entwine, Reset=Button(), Threshold=1e-15, Tolerance=0.01, On=Toggle(True))  # -> I, V, O
unflatten = UnflattenTree(Tree=solver.O, Guide=entwine)
bang = ExplodeTree(Data=unflatten)  # -> Branch0, Branch1, Branch2, Branch3, Branch4, Branch5, Branch6, Branch7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
join_2 = JoinCurves(Curves=bang.Branch0, Preserve=True)
lng = ListLength(List=join_2)
data_2 = Data([bang.Branch7, bang.Branch9, bang.Branch8])
split = SplitList(List=join_2, Index=expr("x/2", lng))  # -> ListA, ListB
disc_2 = Discontinuity(Curve=split.ListA, Level=1)  # -> Points, Parameters
flip_3 = FlipMatrix(Data=disc_2.Points)
avr = Average(Input=flip_3)  # -> flatten(ArithmeticMean)
number_slider_3 = Slider(0, range=0..1)
disc_3 = Discontinuity(Curve=split.ListB, Level=1)  # -> Points, Parameters
vec2pt = Vector2Pt(PointA=disc_3.Points, PointB=avr, Unitize=True)  # -> Vector, Length
vec2pt_2 = Vector2Pt(PointA=disc_2.Points, PointB=avr, Unitize=True)  # -> Vector, Length
amp = Amplitude(Vector=vec2pt.Vector, Amplitude=number_slider_3)
amp_2 = Amplitude(Vector=vec2pt_2.Vector, Amplitude=number_slider_3)
python_3 = PythonScript(x=amp)  # -> a, b; inputs x: tree of Vector3d
# ---------- python_3: Python ----------
import Rhino.Geometry as rg
import dlc

bigVecList=[]
bigDirList = []

for j in range(x.BranchCount):
    branch = x.Branch(j)
    vecList = []
    dirList = []

    for i in range(len(branch)):
        
        if i%2==0:
            rg.Vector3d.Reverse(branch[i])
            vecList.append(branch[i])
            dirList.append(True)
        else:
            vecList.append(branch[i])
            dirList.append(False)


    bigVecList.append(vecList)
    bigDirList.append(dirList)



a = dlc.listToDataTree(bigVecList)
b = dlc.listToDataTree(bigDirList)
# ---------- end python_3 ----------
python_4 = PythonScript(x=amp_2)  # -> a, b; inputs x: tree of Vector3d
# ---------- python_4: Python ----------
import Rhino.Geometry as rg
import dlc

bigVecList=[]
bigDirList = []

for j in range(x.BranchCount):
    branch = x.Branch(j)
    vecList = []
    dirList = []

    for i in range(len(branch)):
        
        if i%2==0:
            
            vecList.append(branch[i])
            dirList.append(True)
        else:
            rg.Vector3d.Reverse(branch[i])
            vecList.append(branch[i])
            dirList.append(False)


    bigVecList.append(vecList)
    bigDirList.append(dirList)



a = dlc.listToDataTree(bigVecList)
b = dlc.listToDataTree(bigDirList)
# ---------- end python_4 ----------
vdis = VectorDisplay(Anchor=disc_3.Points, Vector=python_3.a)
move_2 = Move(Geometry=disc_3.Points, Motion=python_3.a)  # -> Geometry, Transform
move_3 = Move(Geometry=disc_2.Points, Motion=python_4.a)  # -> Geometry, Transform
intcrv = Interpolate(Vertices=move_3.Geometry, Degree=3, Periodic=False, KnotStyle=1)  # -> Curve, Length, Domain
intcrv_2 = Interpolate(Vertices=move_2.Geometry, Degree=3, Periodic=False, KnotStyle=1)  # -> Curve, Length, Domain
number_slider_4 = Slider(2, range=0..5)
python_5 = PythonScript()  # -> out, a
# ---------- python_5: Python ----------
import rhinoscriptsyntax
import Rhino

FILE_NAME = "C:\Users\patri\Desktop\braid-evolution\unity\interactive-braid-evolution\Assets\Geometry\test"

for q in range (0,len(Brep)):
  Rhino.RhinoDoc.ActiveDoc.Objects.AddBrep(Brep[q], Rhino.DocObjects.ObjectAttributes())

rhinoscriptsyntax.Command("SelAll")
rhinoscriptsyntax.Command("-Export " + FILE_NAME + ".obj y=n Enter Enter") #y=n turns off silly Y/Z axis swap! Use no spaces in the file path.
rhinoscriptsyntax.Command("Delete Enter")
# ---------- end python_5 ----------
previewlw = CustomPreviewLineweights(Geometry=intcrv.Curve, Shader=ColourSwatch(SwatchColor=RGB(255, 136, 0)), Thickness=number_slider_4, Absolute=False)
previewlw_2 = CustomPreviewLineweights(Geometry=intcrv_2.Curve, Shader=ColourSwatch(SwatchColor=RGB(0, 119, 255)), Thickness=number_slider_4, Absolute=False)
