# Grasshopper definition cita-braidifier.gh (Grasshopper 0.9.76)
# plug-ins: Python Interpreter, gHowl, Mesh Pipe, PolyMesh_GH

port_to_receive_on = Panel("8051")
ip_to_receive_on_this_computer = Panel("10.1.45.172")
udp = UDPReceiver(Address=ip_to_receive_on_this_computer, Port=port_to_receive_on, Pattern=0)  # -> Info, Data
panel = Panel(udp.Info)
python = PythonScript(data=udp.Data)  # -> vector_list, id
# ---------- python: Python ----------
import json 
import Rhino.Geometry as r

j = json.loads(data)
vector_list = [] 

for vector in j['vectors']: 
    # SWAPPED Y AND Z VALUES, NO IDEA WHY DUDE
    point = r.Point3d(vector['x'], vector['z'], vector['y'])
    vector_list.append(point)
    id = j['id']
# ---------- end python ----------

pline = PolyLine(Vertices=python.vector_list, Closed=False)
explode = Explode(Curve=pline, Recursive=True)  # -> Segments, Vertices
len = Length(Curve=explode.Segments)
multiplication = Multiplication(A=len, B=Slider(2.033, range=0..10))
divide = DivideCurve(Curve=explode.Segments, Count=multiplication, Kinks=False)  # -> Points, Tangents, Parameters
pline_2 = PolyLine(Vertices=flatten(divide.Points), Closed=False)
explode_2 = Explode(Curve=pline_2, Recursive=True)  # -> Segments, Vertices
shift = ShiftList(List=explode_2.Segments, Shift="-1", Wrap="false")
shift_2 = ShiftList(List=explode_2.Segments, Shift=1, Wrap="false")
rev = Reverse(Vector=shift)
end = EndPoints(Curve=shift)  # -> Start, End
xz = XZPlane(Origin=Point(0, 0, 0))
unit = UnitVector(Vector=rev)
unit_2 = UnitVector(Vector=shift_2)
angle = Angle(VectorA=unit, VectorB=unit_2, Plane=xz)  # -> Angle, Reflex
division = Division(A=angle.Reflex, B="2")
Y = UnitY(Factor=1)
vrot = Rotate(Vector=unit, Axis=Y, Angle=division)
Y_2 = UnitY(Factor=1)
pl = ConstructPlane(Origin=end.End, XAxis=vrot, YAxis=Y_2)
vdisex = VectorDisplayEx(Point=end.End, Vector=vrot, Colour=RGB(0, 0, 0), Width=2)

crv_cp = CurveClosestPoint(Point=explode_2.Vertices, Curve=reparameterize(pline_2))  # -> Point, Parameter, Distance
graph = GraphMapper(
    crv_cp.Parameter,
    x0=0,
    x1=2,
    y0=0,
    y1=1,
    container_name="Sine",
    Equation_px=[0.3076923192, 0.1502045244],
    Equation_py=[0.289855063, 1])
shift_3 = ShiftList(List=graph, Shift="-1", Wrap="false")
shift_4 = ShiftList(List=shift_3, Shift=1, Wrap="false")

cir = Circle(Plane=pl, Radius=shift_4)
divide_2 = DivideCurve(Curve=cir, Count=10, Kinks=False)  # -> Points, Tangents, Parameters
pline_3 = PolyLine(Vertices=divide_2.Points, Closed=True)  # -> flatten(Polyline)
vb = VBScript(x=pline_3, Reference="C:\Users\pves\AppData\Roaming\Grasshopper\Libraries\PolyMesh_Core.dll")  # -> out, A; inputs x: list of Polyline
# ---------- vb: C# ----------
    a = polymesh.LoftPolylines(x)
# ---------- end vb ----------
P = PolyMesh(vb.A)
getedges = GetEdges(PolyMesh=P)  # -> Edges, Naked
eval = EvaluateCurve(Curve=getedges.Edges, Parameter=".5")  # -> Point, Tangent, Angle
crv_cp_2 = CurveClosestPoint(Point=eval.Point, Curve=pline_2)  # -> Point, Parameter, Distance
multiplication_2 = Multiplication(A=crv_cp_2.Distance, B="2")
weaver = Weaver(PolyMesh=P, Colors=multiplication_2, Depth=0.1, Triangle=1, Type=2)
fjoin = FastJoin(Polylines=flatten(weaver))  # -> Polylines, Indices
mpipe = MeshPipe(
    Curve=fjoin.Polylines,
    Radius=Slider(0.06, range=0.01..1),
    Accuracy=0.2,
    Rotation=0,
    Segments=Slider(6, range=0..10),
    Caps=2)
lng = ListLength(List=mpipe)
demesh = DeconstructMesh(Mesh=mpipe)  # -> Vertices, Faces, Colours, Normals
random = Random(Range=Domain(0, 1), Number=lng, Seed=2)
hsl = ColourHSL(Alpha=1, Hue=random, Saturation=1, Luminance=0.5)
conmesh = ConstructMesh(Vertices=demesh.Vertices, Faces=demesh.Faces, Colours=graft(hsl))  # -> flatten(Mesh)
mjoin = MeshJoin(Meshes=conmesh)

directorypath_with_backslashes_no_spaces = Panel("C:\Users\pves\Desktop\braid-evolution\unity\interactive-braid-evolution\Assets\Geometry\Models\")  # "DirectoryPath with Backslashes NO SPACES and FileName Minus Extension"
num = Number(python.id)
bake_step = PythonScript(mesh=mjoin)  # -> a; inputs mesh: Mesh
# ---------- bake_step: Python ----------
import Rhino as rc
import Rhino.Geometry as r
import scriptcontext as sc 
import rhinoscriptsyntax as rs

sc.doc = rc.RhinoDoc.ActiveDoc
#rs.AddMesh(mesh, mesh)
rc.RhinoDoc.ActiveDoc.Objects.AddMesh(mesh)
a = True
# ---------- end bake_step ----------
export_step = PythonScript(shouldExport=bake_step, path=directorypath_with_backslashes_no_spaces, id=num)  # -> should_export, id
# ---------- export_step: Python ----------
import rhinoscriptsyntax
import Rhino

FILE_NAME = path + "cita_braid_" + id.ToString()    
rhinoscriptsyntax.Command("SelAll")
rhinoscriptsyntax.Command("-Export " + FILE_NAME + ".obj y=n Enter Enter") #y=n turns off silly Y/Z axis swap! Use no spaces in the file path.
rhinoscriptsyntax.Command("Delete Enter")

should_export = True
# ---------- end export_step ----------
json_encoder = PythonScript(is_models_ready=export_step.should_export, id=export_step.id)  # -> jsonString; inputs is_models_ready: Boolean
# ---------- json_encoder: Python ----------
import json 

if is_models_ready: 
    jsonString = json.dumps({
        'should_import' : 1, 
        'id' : id
    })
# ---------- end json_encoder ----------
panel_2 = Panel(json_encoder)

# ---- group: Network configuration
ip_to_send_to = Panel("10.1.45.172")
port_to_send_to = Panel("8050")
udp_2 = UDPSender(Address=ip_to_send_to, Port=port_to_send_to, Pattern=0, Data=json_encoder)
panel_3 = Panel(udp_2)
