# Grasshopper definition cita-plugin-example.gh (Grasshopper 0.9.76)
# plug-ins: Mesh Pipe, PolyMesh_GH

# ---- group: polylines
number_slider = Slider(4, range=0..10)
random = Random(Range="0.25 to 0.75", Number=number_slider, Seed=number_slider)
pi = Pi(Factor=random)
lng = ListLength(List=pi)
xz = XZPlane(Origin=Point(0, 0, 0))
series = Series(Start="1", Step=1, Count=lng)
pt = PointPolar(BasePlane=xz, XYAngle=pi, ZAngle=0, Offset=series)
pline = PolyLine(Vertices=pt, Closed=False)

number_slider_2 = Slider(5, range=0..10)
random_2 = Random(Range="0.25 to 0.75", Number=number_slider_2, Seed=number_slider_2)
pi_2 = Pi(Factor=random_2)
lng_2 = ListLength(List=pi_2)
xz_2 = XZPlane(Origin=Point(0, 0, 0))
series_2 = Series(Start="1", Step=1, Count=lng_2)
pt_2 = PointPolar(BasePlane=xz_2, XYAngle=pi_2, ZAngle=0, Offset=series_2)
pline_2 = PolyLine(Vertices=pt_2, Closed=False)

number_slider_3 = Slider(3, range=0..10)
random_3 = Random(Range="0.25 to 0.75", Number=number_slider_3, Seed=number_slider_3)
pi_3 = Pi(Factor=random_3)
lng_3 = ListLength(List=pi_3)
xz_3 = XZPlane(Origin=Point(0, 0, 0))
series_3 = Series(Start="1", Step=1, Count=lng_3)
pt_3 = PointPolar(BasePlane=xz_3, XYAngle=pi_3, ZAngle=0, Offset=series_3)
pline_3 = PolyLine(Vertices=pt_3, Closed=False)

merge = Merge(Data1=pline, Data2=pline_2, Data3=pline_3)

# ----
explode = Explode(Curve=merge, Recursive=True)  # -> Segments, Vertices
len = Length(Curve=explode.Segments)
multiplication = Multiplication(A=len, B=Slider(5, range=0..10))
divide = DivideCurve(Curve=explode.Segments, Count=multiplication, Kinks=False)  # -> Points, Tangents, Parameters
pshift = ShiftPaths(Data=divide.Points, Offset=-1)
pline_4 = PolyLine(Vertices=pshift, Closed=False)
explode_2 = Explode(Curve=pline_4, Recursive=True)  # -> Segments, Vertices
shift = ShiftList(List=explode_2.Segments, Shift="-1", Wrap="false")
shift_2 = ShiftList(List=explode_2.Segments, Shift=1, Wrap="false")
rev = Reverse(Vector=shift)
end = EndPoints(Curve=shift)  # -> Start, End
xz_4 = XZPlane(Origin=Point(0, 0, 0))
unit = UnitVector(Vector=rev)
unit_2 = UnitVector(Vector=shift_2)
angle = Angle(VectorA=unit, VectorB=unit_2, Plane=xz_4)  # -> Angle, Reflex
division = Division(A=angle.Reflex, B="2")
Y = UnitY(Factor=1)
vrot = Rotate(Vector=unit, Axis=Y, Angle=division)
Y_2 = UnitY(Factor=1)
pl = ConstructPlane(Origin=end.End, XAxis=vrot, YAxis=Y_2)
vdisex = VectorDisplayEx(Point=end.End, Vector=vrot, Colour=RGB(0, 0, 0), Width=2)

crv_cp = CurveClosestPoint(Point=explode_2.Vertices, Curve=reparameterize(pline_4))  # -> Point, Parameter, Distance
graph = GraphMapper(
    crv_cp.Parameter,
    x0=0,
    x1=1,
    y0=0,
    y1=1,
    container_name="Sine",
    Equation_px=[0.3488103747, 0.1502045244],
    Equation_py=[0.3466666341, 1])
shift_3 = ShiftList(List=graph, Shift="-1", Wrap="false")
shift_4 = ShiftList(List=shift_3, Shift=1, Wrap="false")

max_radius = Slider(0.5, range=0..1)
multiplication_2 = Multiplication(A=shift_4, B=max_radius)

cir = Circle(Plane=pl, Radius=multiplication_2)  # -> simplify(Circle)
divide_2 = DivideCurve(Curve=cir, Count=10, Kinks=False)  # -> Points, Tangents, Parameters
pline_5 = PolyLine(Vertices=divide_2.Points, Closed=True)
pshift_2 = ShiftPaths(Data=pline_5, Offset=-1)
vb = VBScript(x=pshift_2, Reference="C:\Users\Mateusz\Source\Workspaces\AllBuild\PolyMesh_Core.dll")  # -> out, A; inputs x: list of Polyline
# ---------- vb: C# ----------
    
    a = polymesh.LoftPolylines(x)
# ---------- end vb ----------
P = PolyMesh(vb.A)
getedges = GetEdges(PolyMesh=P)  # -> Edges, Naked
eval = EvaluateCurve(Curve=getedges.Edges, Parameter=".5")  # -> Point, Tangent, Angle
crv_cp_2 = CurveClosestPoint(Point=eval.Point, Curve=pline_4)  # -> Point, Parameter, Distance

# ---- group: Colors
bnd = Bounds(Numbers=flatten(multiplication_2))
remap = RemapNumbers(Value=crv_cp_2.Distance, Source=bnd, Target="1 to 2")  # -> Mapped, Clipped

# ----
weaver = Weaver(PolyMesh=P, Colors=remap.Mapped, Depth=0.1, Triangle=1, Type=2)
fjoin = FastJoin(Polylines=flatten(weaver))  # -> Polylines, Indices
mpipe = MeshPipe(
    Curve=fjoin.Polylines,
    Radius=Slider(0.03, range=0.01..1),
    Accuracy=0.2,
    Rotation=0,
    Segments=Slider(6, range=0..10),
    Caps=2)
lng_4 = ListLength(List=mpipe)
demesh = DeconstructMesh(Mesh=mpipe)  # -> Vertices, Faces, Colours, Normals
random_4 = Random(Range=Domain(0, 1), Number=lng_4, Seed=2)
hsl = ColourHSL(Alpha=1, Hue=random_4, Saturation=1, Luminance=0.5)
conmesh = ConstructMesh(Vertices=demesh.Vertices, Faces=demesh.Faces, Colours=graft(hsl))  # -> flatten(Mesh)
mjoin = MeshJoin(Meshes=conmesh)
