# Grasshopper definition cppn-experiment.gh (Grasshopper 0.9.76)
# plug-ins: Anemone, Octopus

# ---- group: Simple NEAT Loop without objective
setbase_octevolearn = BreederSettingsBasicsOEL(
    PopulationSize=Slider(2, range=0..10),
    MaxSpeciesP=0.2,
    NoveltySearch=0,
    MultiObjective=0,
    Seed=3008,
    RecHist=0,
    SaveInterv=0,
    RecordFailed=0,
    Memory=0.2,
    Reset=True)
loop_start = LoopStart(Repeat=Slider(9, range=0..10))  # -> port, Counter, Data
neat_octevolearn = BreederOEL(
    Inputs=Slider(2, range=0..10),
    Outputs=Slider(2, range=0..10),
    Generations=Slider(0, range=0..10),
    Functions=["SteepenedSigmoid .1", "BipolarSigmoid .1", "Gaussian .1", "Linear .1", "Sine .1", "Cosine .1", "Ramp .1", "Spike .1", "Step .1", "Tangent .1", "HyperbolicTangent .1", "Modulus .1"],
    Settings=setbase_octevolearn,
    SeedNetworks=loop_start.Data,
    Run=Toggle(True),
    dialogWindowSpawningOn=False,
    iterParameters_propagates_propagate0_class="Octopus.ghSharpNeatLib.Param_GH_Network, Octopus, Version=1.0.0.0, Culture=neutral, PublicKeyToken=null",
    iterParameters_propagates_propagate0_id="N",
    iterParameters_propagates_propagate0_numTargets=1,
    iterParameters_propagates_propagate0_target=evaln_octevolearn,
    iterParameters_propagates_propagate1_class="Grasshopper.Kernel.Parameters.Param_Integer, Grasshopper, Version=1.0.0.20, Culture=neutral, PublicKeyToken=dda4f5ec2cd80803",
    iterParameters_propagates_propagate1_id="C",
    iterParameters_propagates_propagate1_numTargets=0,
    iterParameters_receivers_receiver0_class="Grasshopper.Kernel.Parameters.Param_Number, Grasshopper, Version=1.0.0.20, Culture=neutral, PublicKeyToken=dda4f5ec2cd80803",
    iterParameters_receivers_receiver0_id="Obj",
    iterParameters_receivers_receiver0_numTargets=0,
    iterParameters_receivers_receiver1_class="Grasshopper.Kernel.Parameters.Param_Number, Grasshopper, Version=1.0.0.20, Culture=neutral, PublicKeyToken=dda4f5ec2cd80803",
    iterParameters_receivers_receiver1_id="B",
    iterParameters_receivers_receiver1_numTargets=0,
    iterParameters_receivers_receiver2_class="Grasshopper.Kernel.Parameters.Param_GenericObject, Grasshopper, Version=1.0.0.20, Culture=neutral, PublicKeyToken=dda4f5ec2cd80803",
    iterParameters_receivers_receiver2_id="P",
    iterParameters_receivers_receiver2_numTargets=0,
    iterParameters_receivers_receiver3_class="Grasshopper.Kernel.Parameters.Param_Boolean, Grasshopper, Version=1.0.0.20, Culture=neutral, PublicKeyToken=dda4f5ec2cd80803",
    iterParameters_receivers_receiver3_id="Cons",
    iterParameters_receivers_receiver3_numTargets=0,
    iterParameters_receivers_receiver4_class="Grasshopper.Kernel.Parameters.Param_Boolean, Grasshopper, Version=1.0.0.20, Culture=neutral, PublicKeyToken=dda4f5ec2cd80803",
    iterParameters_receivers_receiver4_id="E",
    iterParameters_receivers_receiver4_numTargets=0,
    AutoRebuild_flag=True,
    EvaluationUnits_unit0_description="Evaluate Network Solutions",
    EvaluationUnits_unit0_name="Eval",
    EvaluationUnits_unit0_numControllers=2,
    EvaluationUnits_unit0_numPropagates=2,
    EvaluationUnits_unit0_numReceivers=5,
    EvaluationUnits_unit0_propagate0_id="N",
    EvaluationUnits_unit0_propagate1_id="C",
    EvaluationUnits_unit0_receiver0_id="Obj",
    EvaluationUnits_unit0_receiver1_id="B",
    EvaluationUnits_unit0_receiver2_id="P",
    EvaluationUnits_unit0_receiver3_id="Cons",
    EvaluationUnits_unit0_receiver4_id="E")  # -> simplify(graft(EvolvedNetworks)), FailedNetworks, Info, SavedNetworks
construct_solution = ConstructSolution(Phenotype=neat_octevolearn.EvolvedNetworks)  # -> flatten(Solutions)
select_solutions = SelectSolutions(
    Solutions=construct_solution,
    NoOfCols_NoOfCols=5,
    HeightOfRows_HeightOfRows=150,
    windowHeight_windowHeight=1048,
    windowWidth_windowWidth=1938,
    opacity_opacity=0.45725)
deconstruct_solution = DeconstructSolution(Solutions=select_solutions)  # -> Parameters, Objectives, ObjDescr, Phenotype
loop_end = LoopEnd(
    port=loop_start.port,
    Exit=False,
    Data=deconstruct_solution.Phenotype,
    pausedState=False,
    state="Constant output",
    TimeOutVal=0)

# ---- group: Simple Loop with Anemone
number_slider = Slider(9, range=0..10)
loop_start_2 = LoopStart(Repeat=number_slider, Trigger=number_slider, Data=Slider(0, range=0..10))  # -> port, Counter, Data
addition = Addition(A=loop_start_2.Data, B=Slider(2, range=0..10))
loop_end_2 = LoopEnd(port=loop_start_2.port, Exit=False, Data=addition, pausedState=False, state="Constant output", TimeOutVal=0)
panel = Panel(loop_end_2)

# ----
evaln_octevolearn = EvaluateNetworkOEL(Input=Slider(1, range=0..5))
panel_2 = Panel(evaln_octevolearn)
panel_3 = Panel(neat_octevolearn.Info)
panel_4 = Panel(loop_end)
