# Grasshopper definition mesh_braidify.gh (Grasshopper 0.9.76)
# plug-ins: MeshEdit Components, Human, Kangaroo Components, Mesh Pipe

Y = Slider(3, range=0..10)
Z = Slider(7, range=0..10)
height = Slider(5, range=0..10)
pt = ConstructPoint(XCoordinate=0, YCoordinate=0, ZCoordinate=0)
Z_2 = UnitZ(Factor=height)
move = Move(Geometry=pt, Motion=Z_2)  # -> Geometry, Transform
Y_2 = UnitY(Factor=Y)
Z_3 = UnitZ(Factor=Z)
Y_3 = UnitY(Factor=Y)  # -> expr("-x", UnitVector)
Z_4 = UnitZ(Factor=Z)
addition = Addition(A=Y_2, B=Z_3)
addition_2 = Addition(A=Y_3, B=Z_4)
move_2 = Move(Geometry=move.Geometry, Motion=addition_2)  # -> Geometry, Transform
move_3 = Move(Geometry=move.Geometry, Motion=addition)  # -> Geometry, Transform
ln = Line(StartPoint=move.Geometry, EndPoint=move_3.Geometry)
ln_2 = Line(StartPoint=pt, EndPoint=move.Geometry)
ln_3 = Line(StartPoint=move.Geometry, EndPoint=move_2.Geometry)

# ---- group: parameter B C
number_slider = Slider(0.2, range=0..1)
number_slider_2 = Slider(1, range=0..1)

# ---- group: parameter A
number_slider_3 = Slider(0, range=0..1)
number_slider_4 = Slider(1, range=0..1)

# ----
eval = EvaluateCurve(Curve=reparameterize(ln_2), Parameter=[number_slider_3, number_slider_4])  # -> Point, Tangent, Angle
eval_2 = EvaluateCurve(Curve=reparameterize(ln_3), Parameter=[number_slider, number_slider_2])  # -> Point, Tangent, Angle
eval_3 = EvaluateCurve(Curve=reparameterize(ln), Parameter=[number_slider, number_slider_2])  # -> Point, Tangent, Angle
number_slider_5 = Slider(1, range=0..1)
circle = CircleCNR(Center=eval_3.Point, Normal=ln, Radius=expr("x/2", number_slider_5))
circle_2 = CircleCNR(Center=eval_2.Point, Normal=ln_3, Radius=expr("x/2", number_slider_5))
circle_3 = CircleCNR(Center=eval.Point, Normal=ln_2, Radius=number_slider_5)
loft = Loft(Curves=circle, Options={Adjust=False, Closed=False, LoftEnds=0, LoftSimp=0, LoftType=0, Rebuild=10, Refit=0.01})
loft_2 = Loft(Curves=circle_2, Options={Adjust=False, Closed=False, LoftEnds=0, LoftSimp=0, LoftType=0, Rebuild=10, Refit=0.01})
loft_3 = Loft(Curves=circle_3, Options={Adjust=False, Closed=False, LoftEnds=0, LoftSimp=0, LoftType=0, Rebuild=10, Refit=0.01})
number_slider_6 = Slider(4, range=0..10)
number_slider_7 = Slider(8, range=0..20)
mesh_uv = MeshSurface(Surface=loft, UCount=number_slider_6, VCount=expr("x/2", number_slider_7), Overhang=True, Equalize=False)
mesh_uv_2 = MeshSurface(Surface=loft_2, UCount=number_slider_6, VCount=expr("x/2", number_slider_7), Overhang=True, Equalize=False)
mesh_uv_3 = MeshSurface(Surface=loft_3, UCount=Slider(4, range=0..10), VCount=number_slider_7, Overhang=True, Equalize=False)
clean = CombineClean(Meshes=mesh_uv)
clean_2 = CombineClean(Meshes=mesh_uv_3)
clean_3 = CombineClean(Meshes=mesh_uv_2)
medges = MeshEdges(Mesh=clean)  # -> NakedEdges, InteriorEdges, NonManifoldEdges
medges_2 = MeshEdges(Mesh=clean_2)  # -> NakedEdges, InteriorEdges, NonManifoldEdges
medges_3 = MeshEdges(Mesh=clean_3)  # -> NakedEdges, InteriorEdges, NonManifoldEdges
join = JoinCurves(Curves=medges.NakedEdges, Preserve=False)
join_2 = JoinCurves(Curves=medges_2.NakedEdges, Preserve=False)
join_3 = JoinCurves(Curves=medges_3.NakedEdges, Preserve=False)
item = ListItem(List=join, Index=1, Wrap=True)
item_2 = ListItem(List=join_2, Index=1, Wrap=True)
item_3 = ListItem(List=join_3, Index=0, Wrap=True)
explode = Explode(Curve=item_2, Recursive=True)  # -> Segments, Vertices
explode_2 = Explode(Curve=item, Recursive=True)  # -> Segments, Vertices
shift = ShiftList(List=explode_2.Segments, Shift=Slider(1, range=0..10), Wrap=True)  # -> simplify(graft(List))
explode_3 = Explode(Curve=item_3, Recursive=True)  # -> Segments, Vertices
shift_2 = ShiftList(List=explode_3.Segments, Shift=Slider(3, range=0..10), Wrap=True)  # -> simplify(graft(List))
lng = ListLength(List=explode.Segments)
split = SplitList(List=explode.Segments, Index=expr("x/2", lng))  # -> simplify(graft(ListA)), simplify(graft(ListB))
loft_4 = Loft(
    Curves=simplify([split.ListA, shift_2]),
    Options={Adjust=False, Closed=False, LoftEnds=0, LoftSimp=0, LoftType=0, Rebuild=10, Refit=0.01})
loft_5 = Loft(
    Curves=simplify([shift, split.ListB]),
    Options={Adjust=False, Closed=False, LoftEnds=0, LoftSimp=0, LoftType=0, Rebuild=10, Refit=0.01})
smesh = SimpleMesh(Brep=flatten(loft_5))
smesh_2 = SimpleMesh(Brep=flatten(loft_4))
clean_4 = CombineClean(Meshes=[smesh, smesh_2, clean, clean_2, clean_3])
md = MeshDirection(Mesh=clean_4)
preview = CustomPreview(Geometry=clean_4, Shader=ColourSwatch(SwatchColor=RGBA(255, 255, 255, 28)))

# ---- group: use this if subdivision is in the wrong direction
turn = MeshTurn(Mesh=md)

# ----
mesh = Mesh(turn)
md_2 = MeshDirection(Mesh=mesh)
mesh_2 = Mesh(md_2)
number_slider_8 = Slider(0.56, range=0..1)
faceb = FaceBoundaries(Mesh=md_2)
geo = Geometry(<curve referenced from the Rhino model>)
weaver = Weaver(polylines=geo, separation=number_slider_8)  # -> warp_2, weft_2
weaver_2 = Weaver(polylines=faceb, separation=number_slider_8)  # -> warp_2, weft_2
number_slider_9 = Slider(21, range=0..100)
toggle = BooleanToggle(True)
explode_4 = MeshExplode(Mesh=mesh_2, Interpolate=False)
checkerboard = Checkerboard(Mesh=mesh_2)
item_4 = ListItem(List=weaver_2.weft_2, Index=Slider(6, range=0..10), Wrap=True)
reb = RebuildCurve(Curve=weaver_2.warp_2, Count=number_slider_9, Tangents=toggle)
dispatch = Dispatch(List=explode_4, DispatchPattern=checkerboard)  # -> ListA, ListB
reb_2 = RebuildCurve(Curve=weaver_2.weft_2, Degree=Slider(3, range=0..10), Count=number_slider_9, Tangents=toggle)
number_slider_10 = Slider(0, range=0..10)
preview_2 = CustomPreview(Geometry=dispatch.ListB, Shader=ColourSwatch(SwatchColor=RGBA(255, 255, 255, 52)))
preview_3 = CustomPreview(Geometry=dispatch.ListA, Shader=ColourSwatch(SwatchColor=RGBA(0, 255, 102, 54)))
previewlw = CustomPreviewLineweights(Geometry=reb, Shader=ColourSwatch(SwatchColor=RGB(0, 119, 255)), Thickness=number_slider_10, Absolute=False)
previewlw_2 = CustomPreviewLineweights(Geometry=reb_2, Shader=ColourSwatch(SwatchColor=RGB(255, 94, 0)), Thickness=number_slider_10, Absolute=False)
number_slider_11 = Slider(0.06, range=0..1)
mpipe = MeshPipe(Curve=reb, Radius=number_slider_11, Accuracy=0.2, Rotation=0, Segments=10, Caps=2)
mpipe_2 = MeshPipe(Curve=reb_2, Radius=number_slider_11, Accuracy=0.2, Rotation=0, Segments=10, Caps=2)

# ==== cluster Weaver
separation = ClusterInput()
polylines = ClusterInput()
polylines_2 = Data(polylines)
separation_2 = Data(separation)
disc = Discontinuity(Curve=reparameterize(polylines_2), Level=1)  # -> Points, Parameters
item = ListItem(List=disc.Points, Index=0, Wrap=True)  # -> Item, Item1, Item2, Item3
center = Average(Input=[item.Item, item.Item1, item.Item2, item.Item3])
average = Average(Input=[item.Item3, item.Item])
pl_3pt = Plane3Pt(PointA=item.Item, PointB=item.Item1, PointC=item.Item3)
average_2 = Average(Input=[item.Item1, item.Item2])
average_3 = Average(Input=[item.Item2, item.Item3])
average_4 = Average(Input=[item.Item, item.Item1])
deplane = DeconstructPlane(Plane=pl_3pt)  # -> Origin, XAxis, YAxis, ZAxis
center_2 = Average(Input=[average_4, center, average, item.Item])
center_3 = Average(Input=[item.Item2, average_2, average_3, center])
amp = Amplitude(Vector=deplane.ZAxis, Amplitude=separation_2)
rev = Reverse(Vector=amp)
move = Move(Geometry=center_2, Motion=rev)  # -> Geometry, Transform
move_2 = Move(Geometry=center_3, Motion=amp)  # -> Geometry, Transform
move_3 = Move(Geometry=center_2, Motion=amp)  # -> Geometry, Transform
move_4 = Move(Geometry=center_3, Motion=rev)  # -> Geometry, Transform
merge = Merge(Data1=average_4, Data2=move.Geometry, Data3=average)
merge_2 = Merge(Data1=average_2, Data2=move_2.Geometry, Data3=average_3)
merge_3 = Merge(Data1=item.Item, Data2=move_3.Geometry, Data3=center, Data4=move_4.Geometry, Data5=item.Item2)
intcrv = Interpolate(Vertices=merge, Degree=3, Periodic=False, KnotStyle=1)  # -> Curve, Length, Domain
intcrv_2 = Interpolate(Vertices=merge_3, Degree=3, Periodic=False, KnotStyle=1)  # -> Curve, Length, Domain
intcrv_3 = Interpolate(Vertices=merge_2, Degree=3, Periodic=False, KnotStyle=1)  # -> Curve, Length, Domain
join = JoinCurves(Curves=flatten(intcrv_2.Curve), Preserve=False)
join_2 = JoinCurves(Curves=flatten([intcrv_3.Curve, intcrv.Curve]), Preserve=False)
weft = Data(join)
warp = Data(join_2)
weft_2 = ClusterOutput(weft)
warp_2 = ClusterOutput(warp)
