# Grasshopper definition multiple-braid-export-processer_1.1.gh (Grasshopper 0.9.76)
# plug-ins: Python Interpreter, Anemone, Kangaroo Components

toggle = BooleanToggle(False)
translate_vector = Panel("""{1, 0, 2}
{0, 0, 2}
{2, 0, 2}""")
braid_vectors = Panel("""{0, 0, 0}
{1, 0, 2}
{1, 0, 4}
{3, 0, 6}""")
c_script = CSharpScript(list=braid_vectors)  # -> listlength; inputs list: list
# ---------- c_script: C# ----------
    listlength = list.Count - 1;
# ---------- end c_script ----------
loop_start = LoopStart(Repeat=Slider(2, range=0..5))  # -> port, Counter, Data
loop_start_2 = LoopStart(Repeat=c_script, Trigger=loop_start.Counter)  # -> port, Counter, Data
panel = Panel(loop_start.Counter)

# ---- group: Copy point and translate it
index = Number(loop_start_2.Counter)
braid_vector = ListItem(List=braid_vectors, Index=index, Wrap=True)
translate_vector_2 = ListItem(List=translate_vector, Index=index, Wrap=True)
move = Move(Geometry=braid_vector, Motion=translate_vector_2)  # -> Geometry, Transform
ln = Line(StartPoint=braid_vector, EndPoint=move.Geometry)

# ----
panel_2 = Panel(loop_start_2.Counter)
pt = Point(move.Geometry)

# ---- group: Create mesh from circle that is lofted
eval = EvaluateCurve(Curve=ln, Parameter=[Slider(0, range=0..1), Slider(1, range=0..1)])  # -> Point, Tangent, Angle
circle = CircleCNR(Center=eval.Point, Normal=ln, Radius=Slider(0.3, range=0..1))
loft = Loft(Curves=circle, Options={Adjust=False, Closed=False, LoftEnds=0, LoftSimp=0, LoftType=0, Rebuild=10, Refit=0.01})
mesh_uv = MeshSurface(Surface=loft, UCount=Slider(5, range=0..10), VCount=Slider(8, range=0..20), Overhang=True, Equalize=False)
clean = CombineClean(Meshes=mesh_uv)

# ----
loop_end = LoopEnd(port=loop_start_2.port, Exit=False, Data=flatten(clean), pausedState=False, state="Last & Record", TimeOutVal=0)
mesh = Mesh(loop_end)
panel_3 = Panel(loop_end)

# ---- group: Join braid parts together
mjoin = MeshJoin(Meshes=flatten(mesh))

# ----
browse = BrowseHistory(Iteration=Slider(0, range=0..4), Data_0=loop_end)
directorypath_with_backslashes_no_spaces = Panel("C:\Users\patri\Desktop\braid-evolution\unity\interactive-braid-evolution\Assets\Geometry\Models\")  # "DirectoryPath with Backslashes NO SPACES and FileName Minus Extension"

# ---- group: Export and braidify step
faceb = FaceBoundaries(Mesh=mjoin)
weaver = Weaver(polylines=faceb, separation=Slider(0.02, range=0..1))  # -> warp_2, weft_2
params = Slider(3, range=0..100)
reb = RebuildCurve(Curve=weaver.warp_2, Count=params, Tangents=False)
bake_step = PythonScript(curves=reb, toggle=Toggle(True))  # -> isObjectBaked; inputs curves: list of Curve
# ---------- bake_step: Python ----------
import Rhino as rc
import scriptcontext as sc 
import rhinoscriptsyntax as rs

sc.doc = rc.RhinoDoc.ActiveDoc

if toggle: 
    for item in curves:
        rs.AddPipe(item, 0, 0.1)

sc.doc = ghdoc

isObjectBaked = True
# ---------- end bake_step ----------

# ----
export_step = PythonScript(id=Slider(0, range=0..4), FileNameToSave=directorypath_with_backslashes_no_spaces)  # -> message
# ---------- export_step: Python ----------
import rhinoscriptsyntax
import Rhino

if(shouldExport == True):
    FILE_NAME = FileNameToSave + "braid_" + id.ToString()    
    rhinoscriptsyntax.Command("SelAll")
    rhinoscriptsyntax.Command("-Export " + FILE_NAME + ".obj y=n Enter Enter") #y=n turns off silly Y/Z axis swap! Use no spaces in the file path.
    rhinoscriptsyntax.Command("Delete Enter")
    
    message = "braid_" + id.ToString()    
else :
    message = False
# ---------- end export_step ----------
loop_end_2 = LoopEnd(port=loop_start.port, Exit=False, Data=bake_step, pausedState=False, state="Constant & Record", TimeOutVal=0)
panel_4 = Panel(loop_end_2)

# ==== cluster Weaver
separation = ClusterInput()
polylines = ClusterInput()
polylines_2 = Data(polylines)
separation_2 = Data(separation)
disc = Discontinuity(Curve=reparameterize(polylines_2), Level=1)  # -> Points, Parameters
item = ListItem(List=disc.Points, Index=0, Wrap=True)  # -> Item, Item1, Item2, Item3
center = Average(Input=[item.Item, item.Item1, item.Item2, item.Item3])
pl_3pt = Plane3Pt(PointA=item.Item, PointB=item.Item1, PointC=item.Item3)
average = Average(Input=[item.Item3, item.Item])
average_2 = Average(Input=[item.Item1, item.Item2])
average_3 = Average(Input=[item.Item2, item.Item3])
average_4 = Average(Input=[item.Item, item.Item1])
deplane = DeconstructPlane(Plane=pl_3pt)  # -> Origin, XAxis, YAxis, ZAxis
center_2 = Average(Input=[average_4, center, average, item.Item])
center_3 = Average(Input=[item.Item2, average_2, average_3, center])
amp = Amplitude(Vector=deplane.ZAxis, Amplitude=separation_2)
rev = Reverse(Vector=amp)
move = Move(Geometry=center_2, Motion=rev)  # -> Geometry, Transform
move_2 = Move(Geometry=center_3, Motion=amp)  # -> Geometry, Transform
move_3 = Move(Geometry=center_2, Motion=amp)  # -> Geometry, Transform
move_4 = Move(Geometry=center_3, Motion=rev)  # -> Geometry, Transform
merge = Merge(Data1=average_4, Data2=move.Geometry, Data3=average)
merge_2 = Merge(Data1=average_2, Data2=move_2.Geometry, Data3=average_3)
merge_3 = Merge(Data1=item.Item, Data2=move_3.Geometry, Data3=center, Data4=move_4.Geometry, Data5=item.Item2)
intcrv = Interpolate(Vertices=merge, Degree=3, Periodic=False, KnotStyle=1)  # -> Curve, Length, Domain
intcrv_2 = Interpolate(Vertices=merge_3, Degree=3, Periodic=False, KnotStyle=1)  # -> Curve, Length, Domain
intcrv_3 = Interpolate(Vertices=merge_2, Degree=3, Periodic=False, KnotStyle=1)  # -> Curve, Length, Domain
join = JoinCurves(Curves=flatten(intcrv_2.Curve), Preserve=False)
join_2 = JoinCurves(Curves=flatten([intcrv_3.Curve, intcrv.Curve]), Preserve=False)
weft = Data(join)
warp = Data(join_2)
weft_2 = ClusterOutput(weft)
warp_2 = ClusterOutput(warp)
