# Grasshopper definition multiple-braid-export-processer_1.2_draft.gh (Grasshopper 0.9.76)
# plug-ins: Python Interpreter, Anemone, Kangaroo Components, gHowl

# ---- group: Message reciever
ip_to_receive_on_this_computer = Panel("10.13.1.103")
port_to_receive_on = Panel("8051")
udp = UDPReceiver(Address=ip_to_receive_on_this_computer, Port=port_to_receive_on, Pattern=0)  # -> Info, Data
the_message_coming_from_unity = Panel(udp.Data)
panel = Panel(udp.Info)
json_loader = PythonScript(data=udp.Data)  # -> population_size, height, flatten(vectors)
# ---------- json_loader: Python ----------
import json 
import Rhino.Geometry as g

if(bool(data)): 
    j = json.loads(data)
    vectors = []
    
    for vect in j['vectors']: 
        #vectors.append("{" + repr(int(vect['x'])) + ", " + repr(int(vect['y'])) + ", " + repr(int(vect['z'])) + "}\n")
        vectors.append(g.Point3d(vect['x'], vect['y'], vect['z']))
        
    height = j['height']  
    population_size = j['population_size']
else: 
    height = 1
    population_size = 1

vector = [g.Vector3d(0,0,0),g.Vector3d(0,0,0),g.Vector3d(0,0,0)]
# ---------- end json_loader ----------

# ----
num = Number(json_loader.population_size)
braid_vectors = Panel(json_loader.vectors)
translate_vector = Panel("""{1, 0, 2}
{0, 0, 2}
{2, 0, 2}""")
braid_vectors_2 = Panel("""{0, 0, 0}
{1, 0, 2}
{1, 0, 4}
{3, 0, 6}""")
c_script = CSharpScript(list=braid_vectors)  # -> listlength; inputs list: list
# ---------- c_script: C# ----------
    listlength = list.Count - 1;
# ---------- end c_script ----------
loop_start = LoopStart(Repeat=num, Trigger=num)  # -> port, Counter, Data
loop_start_2 = LoopStart(Repeat=c_script, Trigger=loop_start.Counter)  # -> port, Counter, Data
panel_2 = Panel(loop_start.Counter)

# ---- group: Copy point and translate it
index = Number(loop_start_2.Counter)
braid_vector = ListItem(List=braid_vectors, Index=index, Wrap=True)
translate_vector_2 = ListItem(List=translate_vector, Index=index, Wrap=True)
move = Move(Geometry=braid_vector, Motion=translate_vector_2)  # -> Geometry, Transform
ln = Line(StartPoint=braid_vector, EndPoint=move.Geometry)

# ----
pt = Point(move.Geometry)

# ---- group: Create mesh from circle that is lofted
eval = EvaluateCurve(Curve=ln, Parameter=[Slider(0, range=0..1), Slider(1, range=0..1)])  # -> Point, Tangent, Angle
circle = CircleCNR(Center=eval.Point, Normal=ln, Radius=Slider(0.5, range=0..1))
loft = Loft(Curves=circle, Options={Adjust=False, Closed=False, LoftEnds=0, LoftSimp=0, LoftType=0, Rebuild=10, Refit=0.01})
mesh_uv = MeshSurface(Surface=loft, UCount=Slider(2, range=0..10), VCount=Slider(4, range=0..20), Overhang=True, Equalize=False)
clean = CombineClean(Meshes=mesh_uv)

# ----
loop_end = LoopEnd(port=loop_start_2.port, Exit=False, Data=flatten(clean), pausedState=False, state="Last & Record", TimeOutVal=0)  # -> flatten(Data)
num_2 = Number(num)
panel_3 = Panel(loop_end)
mesh = Mesh(loop_end)
mjoin = MeshJoin(Meshes=mesh)
num_3 = Number(loop_start.Counter)

# ---- group: Export and braidify step
faceb = FaceBoundaries(Mesh=mjoin)
weaver = Weaver(polylines=faceb, separation=Slider(0.03, range=0..1))  # -> warp_2, weft_2
params = Slider(5, range=0..100)
reb = RebuildCurve(Curve=weaver.warp_2, Count=params, Tangents=False)
bake_step = PythonScript(curves=reb, toggle=Toggle(True))  # -> c, isObjectBaked; inputs curves: list of Curve
# ---------- bake_step: Python ----------
import Rhino as rc
import scriptcontext as sc 
import rhinoscriptsyntax as rs

sc.doc = rc.RhinoDoc.ActiveDoc

if toggle: 
    for item in curves:
        rs.AddPipe(item, 0, 0.1)

sc.doc = ghdoc

isObjectBaked = True

c = curves
# ---------- end bake_step ----------

# ----
directorypath_with_backslashes_no_spaces = Panel("C:\Users\patri\Desktop\braid-evolution\unity\interactive-braid-evolution\Assets\Geometry\Models\")  # "DirectoryPath with Backslashes NO SPACES and FileName Minus Extension"
export_step = PythonScript(id=num_3, FileNameToSave=directorypath_with_backslashes_no_spaces, shouldExport=bake_step.isObjectBaked)  # -> message
# ---------- export_step: Python ----------
import rhinoscriptsyntax
import Rhino

if(shouldExport == True):
    FILE_NAME = FileNameToSave + "braid_" + id.ToString()    
    rhinoscriptsyntax.Command("SelAll")
    rhinoscriptsyntax.Command("-Export " + FILE_NAME + ".obj y=n Enter Enter") #y=n turns off silly Y/Z axis swap! Use no spaces in the file path.
    rhinoscriptsyntax.Command("Delete Enter")
    
    message = "braid_" + id.ToString()    
else :
    message = False
# ---------- end export_step ----------
loop_end_2 = LoopEnd(port=loop_start.port, Exit=False, Data=mjoin, pausedState=False, state="Last & Record", TimeOutVal=0)
panel_4 = Panel(loop_end_2)
browse = BrowseHistory(Iteration=Slider(0, range=0..4), Data_0=loop_end_2)
lng = ListLength(List=flatten(panel_4))
python = PythonScript(models_created=flatten(num_3), population_size=flatten(num_2))  # -> flatten(bool), population_size, models_created; inputs models_created: Int32, population_size: Int32
# ---------- python: Python ----------
if models_created == population_size: 
    bool = True 
else: 
    bool = False

models_created = models_created
# ---------- end python ----------
json_encoder = PythonScript(is_models_ready=python.bool, num_models=python.population_size, models_created=python.models_created)  # -> jsonString; inputs is_models_ready: Boolean
# ---------- json_encoder: Python ----------
import json 

if is_models_ready: 
    jsonString = json.dumps({
        'should_import' : 1, 
        'num_models' : num_models, 
        'models_created' : models_created
    })
else: 
    jsonString = json.dumps({
        'should_import' : 0, 
        'num_models' : num_models,
        'models_created' : models_created
    })
# ---------- end json_encoder ----------

# ---- group: Network configuration
ip_to_send_to = Panel("10.13.1.103")
port_to_send_to = Panel("8050")
udp_2 = UDPSender(Address=ip_to_send_to, Port=port_to_send_to, Pattern=0, Data=json_encoder)
panel_5 = Panel(udp_2)

# ==== cluster Weaver
separation = ClusterInput()
polylines = ClusterInput()
polylines_2 = Data(polylines)
separation_2 = Data(separation)
disc = Discontinuity(Curve=reparameterize(polylines_2), Level=1)  # -> Points, Parameters
item = ListItem(List=disc.Points, Index=0, Wrap=True)  # -> Item, Item1, Item2, Item3
center = Average(Input=[item.Item, item.Item1, item.Item2, item.Item3])
pl_3pt = Plane3Pt(PointA=item.Item, PointB=item.Item1, PointC=item.Item3)
average = Average(Input=[item.Item3, item.Item])
average_2 = Average(Input=[item.Item1, item.Item2])
average_3 = Average(Input=[item.Item2, item.Item3])
average_4 = Average(Input=[item.Item, item.Item1])
deplane = DeconstructPlane(Plane=pl_3pt)  # -> Origin, XAxis, YAxis, ZAxis
center_2 = Average(Input=[average_4, center, average, item.Item])
center_3 = Average(Input=[item.Item2, average_2, average_3, center])
amp = Amplitude(Vector=deplane.ZAxis, Amplitude=separation_2)
rev = Reverse(Vector=amp)
move = Move(Geometry=center_2, Motion=rev)  # -> Geometry, Transform
move_2 = Move(Geometry=center_3, Motion=amp)  # -> Geometry, Transform
move_3 = Move(Geometry=center_2, Motion=amp)  # -> Geometry, Transform
move_4 = Move(Geometry=center_3, Motion=rev)  # -> Geometry, Transform
merge = Merge(Data1=average_4, Data2=move.Geometry, Data3=average)
merge_2 = Merge(Data1=average_2, Data2=move_2.Geometry, Data3=average_3)
merge_3 = Merge(Data1=item.Item, Data2=move_3.Geometry, Data3=center, Data4=move_4.Geometry, Data5=item.Item2)
intcrv = Interpolate(Vertices=merge, Degree=3, Periodic=False, KnotStyle=1)  # -> Curve, Length, Domain
intcrv_2 = Interpolate(Vertices=merge_3, Degree=3, Periodic=False, KnotStyle=1)  # -> Curve, Length, Domain
intcrv_3 = Interpolate(Vertices=merge_2, Degree=3, Periodic=False, KnotStyle=1)  # -> Curve, Length, Domain
join = JoinCurves(Curves=flatten(intcrv_2.Curve), Preserve=False)
join_2 = JoinCurves(Curves=flatten([intcrv_3.Curve, intcrv.Curve]), Preserve=False)
weft = Data(join)
warp = Data(join_2)
weft_2 = ClusterOutput(weft)
warp_2 = ClusterOutput(warp)
