# Grasshopper definition scriptable-braid-export-processer_1.0_draft.gh (Grasshopper 0.9.76)
# plug-ins: Python Interpreter, Anemone, Kangaroo Components

# ---- group: Copy point and translate it
index = Number()
braid_vector = ListItem(Index=index, Wrap=True)
translate_vector = ListItem(Index=index, Wrap=True)
move = Move(Geometry=braid_vector, Motion=translate_vector)  # -> Geometry, Transform
ln = Line(StartPoint=braid_vector, EndPoint=move.Geometry)

# ----
loop_start = LoopStart(Repeat=Slider(4, range=0..4))  # -> port, Counter, Data
panel = Panel("""{0,0,0}
{0,0,2}
{0,0,4}
{0,0,6}
{0,0,8}""")
python = PythonScript(multiplier=loop_start.Counter, list=panel)  # -> vect_list; inputs multiplier: Int32, list: list of Point3d
# ---------- python: Python ----------
import Rhino as rc
import Rhino.Geometry as r
import scriptcontext as sc 
import rhinoscriptsyntax as rs

vect_list = []
for i in range(0,len(list)): 
    p1 = r.Point3d(0,0,list[i].Z * multiplier) 
    
    #Do this by using the "MOVE" ? 
    p2 = r.Point3d(p1.X, p1.Y, p1.Z + 2.0)
    
    #vect_list.append(p1)
    #vect_list.append(p2)
    
    line = r.Line(p1, p2)
    curve = r.LineCurve(line)
    
    
    centerPoint = rs.EvaluateCurve(curve, 1.0)
    #vect_list.append(centerPoint)
    
    #Find the closest point on the surface using Rhino.Geometry.Surface.ClosestPoint. 
    #Then use Rhino.Geometry.Surface.NormalAt.
    
    #Make circle and mesh
    radius = 0.5
    plane = line.TryGetPlane()[1] #index 0 is sucess/nosucess and 1 is the actual plane
    
    circle = r.Circle(plane, centerPoint, radius)
    vect_list.append(circle)
# ---------- end python ----------

# ---- group: Create mesh from circle that is lofted
eval = EvaluateCurve(Curve=ln, Parameter=[Slider(0, range=0..1), Slider(1, range=0..1)])  # -> Point, Tangent, Angle
circle = CircleCNR(Center=eval.Point, Normal=ln, Radius=Slider(0.5, range=0..1))
loft = Loft(Curves=circle, Options={Adjust=False, Closed=False, LoftEnds=0, LoftSimp=0, LoftType=0, Rebuild=10, Refit=0.01})
mesh_uv = MeshSurface(Surface=loft, UCount=Slider(2, range=0..10), VCount=Slider(4, range=0..20), Overhang=True, Equalize=False)
clean = CombineClean(Meshes=mesh_uv)

# ----
panel_2 = Panel(python)
loop_end = LoopEnd(port=loop_start.port, Exit=False, Data=python, pausedState=False, state="Constant output", TimeOutVal=0)
panel_3 = Panel(loop_end)
