# Grasshopper definition scriptable-braid-export-processer_1.1_debugger.gh (Grasshopper 0.9.76)
# plug-ins: Python Interpreter, Anemone, gHowl

# ---- group: Message reciever
ip_to_receive_on_this_computer = Panel("10.13.1.113")
port_to_receive_on = Panel("8051")
udp = UDPReceiver(Address=ip_to_receive_on_this_computer, Port=port_to_receive_on, Pattern=0)  # -> Info, Data
the_message_coming_from_unity = Panel(udp.Data)
panel = Panel(udp.Info)
json_loader = PythonScript(data=udp.Data)  # -> population_size, height, flatten(vectors), flatten(braids)
# ---------- json_loader: Python ----------
import json 
import Rhino.Geometry as rg

if(bool(data)): 
    j = json.loads(data)
    braids = []

    for braid in j['braids']:
        vectors = []
        for vector in braid['vectors']: 
            vectors.append(rg.Point3d(vector['x'], vector['y'], vector['z']))
        
        braids.append(vectors)
        
    height = j['height']  
    population_size = j['population_size']
else: 
    height = 1
    population_size = 5

vector = [rg.Vector3d(0,0,0),rg.Vector3d(0,0,0),rg.Vector3d(0,0,0)]
# ---------- end json_loader ----------

# ----
panel_2 = Panel(json_loader.braids)
panel_3 = Panel(json_loader.vectors)
subtraction = Subtraction(A=json_loader.population_size, B=Slider(1, range=0..1))
loop_start = LoopStart(Repeat=subtraction, Trigger=subtraction)  # -> port, Counter, Data
hardcoded_perfect_vectors = Panel("""{0,0,0}
{0,0,2}
{0,0,4}
{0,0,6}
{0,0,8}
{2,0,10}""")
create_mesh_from_points = PythonScript(counter=loop_start.Counter, list=json_loader.braids)  # -> mesh_list; inputs counter: Int32, list: list
# ---------- create_mesh_from_points: Python ----------
import Rhino as rc
import Rhino.Geometry as r
import scriptcontext as sc 
import rhinoscriptsyntax as rs

radius = 0.5
mesh_list = []
index = 0

vect_list = list[counter]

while index < len(vect_list) - 1: 
    print index
    print len(vect_list)
    startPoint = vect_list[index]
    endPoint = vect_list[index + 1]
    
    line = r.Line(startPoint, endPoint)
    curve = r.LineCurve(line)
    
      
    ### PLANES AND CIRCLES ### : 
    planeBegin = r.Plane(line.From, r.Vector3d.Subtract( r.Vector3d(line.From),r.Vector3d(line.To)))
    planeEnd = r.Plane(line.To, r.Vector3d.Subtract( r.Vector3d(line.From),r.Vector3d(line.To)))
    
    circleBegin = r.Circle(planeBegin, radius).ToNurbsCurve()
    circleEnd = r.Circle(planeEnd, radius).ToNurbsCurve() 
    curveList = [circleBegin, circleEnd]
    
    ### BREPS AND MESHES ### : 
    brepSurfaces = r.Brep.CreateFromLoft(curveList, r.Point3d.Unset, r.Point3d.Unset, r.LoftType.Straight, False)    
    
    #TODO: This has 4x too many vertices and faces
    mesh = r.Mesh.CreateFromBrep(brepSurfaces[0], r.MeshingParameters.Minimal)

    mesh_list.append(mesh[0])
    index += 1
# ---------- end create_mesh_from_points ----------
panel_4 = Panel(loop_start.Counter)
panel_5 = Panel(create_mesh_from_points)
num = Number(loop_start.Counter)
num_2 = Number(json_loader.population_size)

# ---- group: Export and braidify step
faceb = FaceBoundaries(Mesh=create_mesh_from_points)
reb = RebuildCurve(Count=10, Tangents=False)
bake_step = PythonScript(curves=reb, toggle=Toggle(True))  # -> c, isObjectBaked; inputs curves: list of Curve
# ---------- bake_step: Python ----------
import Rhino as rc
import scriptcontext as sc 
import rhinoscriptsyntax as rs

sc.doc = rc.RhinoDoc.ActiveDoc

if toggle: 
    for item in curves:
        rs.AddPipe(item, 0, 0.1)

sc.doc = ghdoc

isObjectBaked = True

c = curves
# ---------- end bake_step ----------

# ----
directorypath_with_backslashes_no_spaces = Panel("C:\Users\patri\Desktop\braid-evolution\unity\interactive-braid-evolution\Assets\Geometry\Models\")  # "DirectoryPath with Backslashes NO SPACES and FileName Minus Extension"
export_step = PythonScript(id=num, FileNameToSave=directorypath_with_backslashes_no_spaces, shouldExport=bake_step.isObjectBaked)  # -> message
# ---------- export_step: Python ----------
import rhinoscriptsyntax
import Rhino

if(shouldExport == True):
    FILE_NAME = FileNameToSave + "braid_" + id.ToString()    
    rhinoscriptsyntax.Command("SelAll")
    rhinoscriptsyntax.Command("-Export " + FILE_NAME + ".obj y=n Enter Enter") #y=n turns off silly Y/Z axis swap! Use no spaces in the file path.
    rhinoscriptsyntax.Command("Delete Enter")
    
    message = "braid_" + id.ToString()    
else :
    message = False
# ---------- end export_step ----------
loop_end = LoopEnd(port=loop_start.port, Exit=False, Data=export_step, pausedState=False, state="Last & Record", TimeOutVal=0)
panel_6 = Panel(loop_end)
python = PythonScript(models_created=flatten(num), population_size=flatten(num_2))  # -> flatten(bool), population_size, models_created; inputs models_created: Int32, population_size: Int32
# ---------- python: Python ----------
if models_created == population_size: 
    bool = True 
else: 
    bool = False

models_created = models_created + 1
# ---------- end python ----------
json_encoder = PythonScript(is_models_ready=python.bool, num_models=python.population_size, models_created=python.models_created)  # -> jsonString; inputs is_models_ready: Boolean
# ---------- json_encoder: Python ----------
import json 

if is_models_ready: 
    jsonString = json.dumps({
        'should_import' : 1, 
        'num_models' : num_models, 
        'models_created' : models_created
    })
else: 
    jsonString = json.dumps({
        'should_import' : 0, 
        'num_models' : num_models,
        'models_created' : models_created
    })
# ---------- end json_encoder ----------
panel_7 = Panel(json_encoder)

# ---- group: Network configuration
ip_to_send_to = Panel("10.13.1.113")
port_to_send_to = Panel("8050")
udp_2 = UDPSender(Address=ip_to_send_to, Port=port_to_send_to, Pattern=0, Data=json_encoder)
panel_8 = Panel(udp_2)
