# Grasshopper definition scriptable-braid-export-processer_2.0-tester.gh (Grasshopper 0.9.76)
# plug-ins: Python Interpreter, Anemone, gHowl

# ---- group: Message reciever
ip_to_receive_on_this_computer = Panel("10.1.45.172")
port_to_receive_on = Panel("8051")
udp = UDPReceiver(Address=ip_to_receive_on_this_computer, Port=port_to_receive_on, Pattern=0)  # -> Info, Data
the_message_coming_from_unity = Panel(udp.Data)
panel = Panel(udp.Info)
json_loader = PythonScript(data=udp.Data)  # -> population_size, flatten(braid_vectors), radius_values
# ---------- json_loader: Python ----------
import json 
import Rhino.Geometry as rg

if(bool(data)): 
    j = json.loads(data)
    braid_vectors = []
    radius_values = [] 
    
    for braid in j['braids']:
        vectors = []
        temp_list = []
        
        for vector in braid['vectors2']: 
            #vectors.append(rg.Point3d(vector['x'], vector['y'], vector['z']))
            vectors.append(vector)
        
        if braid['rad_values'] != None: 
            temp_r_list = []
            for val in braid['rad_values']: 
                temp_r_list.append(val)
                
            radius_values.append(temp_r_list)
            
        #radius_values.append(temp_list)
        braid_vectors.append(vectors)
        
    height = j['height']  
    population_size = j['population_size']
else: 
    height = 1
    population_size = 5

vector = [rg.Vector3d(0,0,0),rg.Vector3d(0,0,0),rg.Vector3d(0,0,0)]
# ---------- end json_loader ----------

# ----
panel_2 = Panel(json_loader.braid_vectors)
subtraction = Subtraction(A=json_loader.population_size, B=Slider(1, range=0..1))
hardcoded_perfect_vectors = Panel("""{0,0,0}
{0,0,2}
{0,0,4}
{0,0,6}
{0,0,8}
{2,0,10}""")
loop_start = LoopStart(Repeat=subtraction, Trigger=subtraction)  # -> port, Counter, Data
create_mesh_from_points = PythonScript(counter=loop_start.Counter, radius_lists=json_loader.radius_values, braid_lists=json_loader.braid_vectors)  # -> mesh_list, a; inputs counter: Int32, radius_lists: list, braid_lists: list
# ---------- create_mesh_from_points: Python ----------
import Rhino as rc
import Rhino.Geometry as r
import scriptcontext as sc 
import rhinoscriptsyntax as rs

default_radius = 0.5
mesh_list = []
a = []
index = 0
radius_index = 0

braid = braid_lists[counter]
m_radius_list = radius_lists[counter]

for branch in braid: 
    while index < len(branch) - 1: 
        startPoint = r.Point3d(branch[index]['x'], branch[index]['y'], branch[index]['z'])
        endPoint = r.Point3d(branch[index + 1]['x'], branch[index + 1]['y'], branch[index + 1]['z'])
        
        a.append(startPoint) 
        a.append(endPoint)
        
        line = r.Line(startPoint, endPoint)
        curve = r.LineCurve(line)
          
        ### PLANES AND CIRCLES ### : 
        planeBegin = r.Plane(line.From, r.Vector3d.Subtract( r.Vector3d(line.From),r.Vector3d(line.To)))
        planeEnd = r.Plane(line.To, r.Vector3d.Subtract( r.Vector3d(line.From),r.Vector3d(line.To)))
        
        circleBegin = r.Circle(planeBegin, m_radius_list[radius_index]).ToNurbsCurve()
        circleEnd = r.Circle(planeEnd, m_radius_list[radius_index + 1]).ToNurbsCurve() 
        
        #circleBegin = r.Circle(planeBegin, default_radius).ToNurbsCurve()
        #circleEnd = r.Circle(planeEnd, default_radius).ToNurbsCurve() 


        curveList = [circleBegin, circleEnd]
        
        ### BREPS AND MESHES ### : 
        brepSurfaces = r.Brep.CreateFromLoft(curveList, r.Point3d.Unset, r.Point3d.Unset, r.LoftType.Straight, False)    
        
        #TODO: This has 4x too many vertices and faces
        if(len(brepSurfaces) > 0):
            mesh = r.Mesh.CreateFromBrep(brepSurfaces[0], r.MeshingParameters.Minimal)
    
        mesh_list.append(mesh[0])
        radius_index += 1
        
        index += 1
    index = 0
# ---------- end create_mesh_from_points ----------
panel_3 = Panel(loop_start.Counter)
panel_4 = Panel(create_mesh_from_points.a)
mesh = Mesh(create_mesh_from_points.mesh_list)
num = Number(loop_start.Counter)
num_2 = Number(json_loader.population_size)
python = PythonScript(mesh=mesh)  # -> a; inputs mesh: Mesh, x: Boolean
# ---------- python: Python ----------
import Rhino as rc
import scriptcontext as sc 
import rhinoscriptsyntax as rs


rc.RhinoDoc.ActiveDoc.Objects.AddMesh(mesh)
a = True
# ---------- end python ----------

# ---- group: Export and braidify step
faceb = FaceBoundaries()
params = Slider(3, range=0..100)
weaver = Weaver(polylines=faceb, separation=Slider(0.01, range=0..1))  # -> warp_2, weft_2
reb = RebuildCurve(Curve=weaver.warp_2, Count=params, Tangents=False)
bake_step = PythonScript(curves=reb, toggle=Toggle(True))  # -> c, isObjectBaked; inputs curves: list of Curve
# ---------- bake_step: Python ----------
import Rhino as rc
import scriptcontext as sc 
import rhinoscriptsyntax as rs

sc.doc = rc.RhinoDoc.ActiveDoc

if toggle: 
    for item in curves:
        rs.AddPipe(item, 0, 0.1)

sc.doc = ghdoc

isObjectBaked = True

c = curves
# ---------- end bake_step ----------

# ----
directorypath_with_backslashes_no_spaces = Panel("C:\Users\pves\Desktop\braid-evolution\unity\interactive-braid-evolution\Assets\Geometry\Models\")  # "DirectoryPath with Backslashes NO SPACES and FileName Minus Extension"
export_step = PythonScript(id=num, FileNameToSave=directorypath_with_backslashes_no_spaces, shouldExport=python)  # -> message
# ---------- export_step: Python ----------
import rhinoscriptsyntax
import Rhino

if(shouldExport == True):
    FILE_NAME = FileNameToSave + "braid_" + id.ToString()    
    rhinoscriptsyntax.Command("SelAll")
    rhinoscriptsyntax.Command("-Export " + FILE_NAME + ".obj y=n Enter Enter") #y=n turns off silly Y/Z axis swap! Use no spaces in the file path.
    rhinoscriptsyntax.Command("Delete Enter")
    
    message = "braid_" + id.ToString()    
else :
    message = False
# ---------- end export_step ----------
loop_end = LoopEnd(port=loop_start.port, Exit=False, Data=export_step, pausedState=False, state="Last & Record", TimeOutVal=0)
panel_5 = Panel(loop_end)
python_2 = PythonScript(models_created=flatten(num), population_size=flatten(num_2))  # -> flatten(bool), population_size, models_created; inputs models_created: Int32, population_size: Int32
# ---------- python_2: Python ----------
if models_created == population_size: 
    bool = True 
else: 
    bool = False

models_created = models_created + 1
# ---------- end python_2 ----------
json_encoder = PythonScript(is_models_ready=python_2.bool, num_models=python_2.population_size, models_created=python_2.models_created)  # -> jsonString; inputs is_models_ready: Boolean
# ---------- json_encoder: Python ----------
import json 

if is_models_ready: 
    jsonString = json.dumps({
        'should_import' : 1, 
        'num_models' : num_models, 
        'models_created' : models_created
    })
else: 
    jsonString = json.dumps({
        'should_import' : 0, 
        'num_models' : num_models,
        'models_created' : models_created
    })
# ---------- end json_encoder ----------
panel_6 = Panel(json_encoder)

# ---- group: Network configuration
ip_to_send_to = Panel("10.1.45.172")
port_to_send_to = Panel("8050")
udp_2 = UDPSender(Address=ip_to_send_to, Port=port_to_send_to, Pattern=0, Data=json_encoder)
panel_7 = Panel(udp_2)

# ==== cluster Weaver
separation = ClusterInput()
polylines = ClusterInput()
polylines_2 = Data(polylines)
separation_2 = Data(separation)
disc = Discontinuity(Curve=reparameterize(polylines_2), Level=1)  # -> Points, Parameters
item = ListItem(List=disc.Points, Index=0, Wrap=True)  # -> Item, Item1, Item2, Item3
center = Average(Input=[item.Item, item.Item1, item.Item2, item.Item3])
average = Average(Input=[item.Item3, item.Item])
pl_3pt = Plane3Pt(PointA=item.Item, PointB=item.Item1, PointC=item.Item3)
average_2 = Average(Input=[item.Item1, item.Item2])
average_3 = Average(Input=[item.Item2, item.Item3])
average_4 = Average(Input=[item.Item, item.Item1])
deplane = DeconstructPlane(Plane=pl_3pt)  # -> Origin, XAxis, YAxis, ZAxis
center_2 = Average(Input=[average_4, center, average, item.Item])
center_3 = Average(Input=[item.Item2, average_2, average_3, center])
amp = Amplitude(Vector=deplane.ZAxis, Amplitude=separation_2)
rev = Reverse(Vector=amp)
move = Move(Geometry=center_2, Motion=rev)  # -> Geometry, Transform
move_2 = Move(Geometry=center_3, Motion=amp)  # -> Geometry, Transform
move_3 = Move(Geometry=center_2, Motion=amp)  # -> Geometry, Transform
move_4 = Move(Geometry=center_3, Motion=rev)  # -> Geometry, Transform
merge = Merge(Data1=average_4, Data2=move.Geometry, Data3=average)
merge_2 = Merge(Data1=average_2, Data2=move_2.Geometry, Data3=average_3)
merge_3 = Merge(Data1=item.Item, Data2=move_3.Geometry, Data3=center, Data4=move_4.Geometry, Data5=item.Item2)
intcrv = Interpolate(Vertices=merge, Degree=3, Periodic=False, KnotStyle=1)  # -> Curve, Length, Domain
intcrv_2 = Interpolate(Vertices=merge_3, Degree=3, Periodic=False, KnotStyle=1)  # -> Curve, Length, Domain
intcrv_3 = Interpolate(Vertices=merge_2, Degree=3, Periodic=False, KnotStyle=1)  # -> Curve, Length, Domain
join = JoinCurves(Curves=flatten(intcrv_2.Curve), Preserve=False)
join_2 = JoinCurves(Curves=flatten([intcrv_3.Curve, intcrv.Curve]), Preserve=False)
weft = Data(join)
warp = Data(join_2)
weft_2 = ClusterOutput(weft)
warp_2 = ClusterOutput(warp)
