# Grasshopper definition simple-braid-export-processer.gh (Grasshopper 0.9.76)
# plug-ins: MeshEdit Components, Python Interpreter, Anemone, Human, Kangaroo Components, gHowl

# ---- group: Message reciever
port_to_receive_on = Panel("8051")
ip_to_receive_on_this_computer = Panel("10.13.1.103")
udp = UDPReceiver(Address=ip_to_receive_on_this_computer, Port=port_to_receive_on, Pattern=0)  # -> Info, Data
the_message_coming_from_unity = Panel(udp.Data)
panel = Panel(udp.Info)
json_loader = PythonScript(data=udp.Data)  # -> height, dictValues, dictObject
# ---------- json_loader: Python ----------
import json 

if(bool(data)): 
    j = json.loads(data)
    dictValues = []

    for item in j:
        dictValues.append(j[item])
        
    height = j['height']        
else: 
    height = 5
#if(bool(j)): #Empty dict evaluates to false in python
   #shouldExport = True

#dictObject = j
# ---------- end json_loader ----------
panel_2 = Panel(json_loader.dictObject)
panel_3 = Panel(json_loader.dictValues)

ip_to_receive_on_this_computer_2 = Panel("10.13.1.103")
port_to_receive_on_2 = Panel("8051")
udp_2 = UDPReceiver(Address=ip_to_receive_on_this_computer_2, Port=port_to_receive_on_2, Pattern=0)  # -> Info, Data
the_message_coming_from_unity_2 = Panel(udp_2.Data)
panel_4 = Panel(udp_2.Info)
json_loader_2 = PythonScript(data=udp_2.Data)  # -> height, dictValues, dictObject; same code as json_loader
panel_5 = Panel(json_loader_2.dictObject)
panel_6 = Panel(json_loader_2.dictValues)

# ----
height = Slider(3, range=0..5)
translate_vector = Panel("""{1, 0, 2}
{0, 0, 2}
{2, 0, 2}""")
braid_vectors = Panel("""{0, 0, 0}
{1, 0, 2}
{1, 0, 4}
{3, 0, 6}""")

# ---- group: Base point
pt = ConstructPoint(XCoordinate=0, YCoordinate=0, ZCoordinate=0)

# ----
c_script = CSharpScript(list=braid_vectors)  # -> listlength; inputs list: list
# ---------- c_script: C# ----------
    listlength = list.Count - 1;
# ---------- end c_script ----------
Z = UnitZ(Factor=json_loader.height)
loop_start = LoopStart(Repeat=c_script, Trigger=braid_vectors, Data=Slider(0, range=0..10))  # -> port, Counter, Data

# ---- group: Sub division point
move = Move(Geometry=pt, Motion=Z)  # -> Geometry, Transform

# ---- group: Params deciding the braid geometry, e.g radius
number_slider = Slider(0, range=0..1)
number_slider_2 = Slider(1, range=0..1)
number_slider_3 = Slider(1, range=0..1)

# ---- group: Copy point and translate it
index = Number(loop_start.Counter)
braid_vector = ListItem(List=braid_vectors, Index=index, Wrap=True)
translate_vector_2 = ListItem(List=translate_vector, Index=index, Wrap=True)
move_2 = Move(Geometry=braid_vector, Motion=translate_vector_2)  # -> Geometry, Transform
ln = Line(StartPoint=braid_vector, EndPoint=move_2.Geometry)

# ---- group: Mesh step 1: Create circle and loft it, based on two points
ln_2 = Line(StartPoint=pt, EndPoint=move.Geometry)
eval = EvaluateCurve(Curve=reparameterize(ln_2), Parameter=[number_slider, number_slider_2])  # -> Point, Tangent, Angle
circle = CircleCNR(Center=eval.Point, Normal=ln_2, Radius=number_slider_3)
loft = Loft(Curves=circle, Options={Adjust=False, Closed=False, LoftEnds=0, LoftSimp=0, LoftType=0, Rebuild=10, Refit=0.01})

# ---- group: Params deciding mesh geometry
number_slider_4 = Slider(5, range=0..10)
number_slider_5 = Slider(8, range=0..20)

# ----
pt_2 = Point(move_2.Geometry)

# ---- group: Create mesh from circle that is lofted
eval_2 = EvaluateCurve(Curve=ln, Parameter=[Slider(0, range=0..1), Slider(1, range=0..1)])  # -> Point, Tangent, Angle
circle_2 = CircleCNR(Center=eval_2.Point, Normal=ln, Radius=Slider(0.4, range=0..1))
loft_2 = Loft(Curves=circle_2, Options={Adjust=False, Closed=False, LoftEnds=0, LoftSimp=0, LoftType=0, Rebuild=10, Refit=0.01})
mesh_uv = MeshSurface(Surface=loft_2, UCount=Slider(5, range=0..10), VCount=Slider(8, range=0..20), Overhang=True, Equalize=False)
clean = CombineClean(Meshes=mesh_uv)

# ---- group: Mesh step 2: Create mesh surface based on "circled loft"
mesh_uv_2 = MeshSurface(Surface=loft, UCount=number_slider_4, VCount=number_slider_5, Overhang=True, Equalize=False)
clean_2 = CombineClean(Meshes=mesh_uv_2)

# ---- group: Params determing the "lines" in a braid
params = Slider(8, range=0..100)
number_slider_6 = Slider(0.04, range=0..1)

# ---- group: Weaverbirds "braidifying effect"
faceb = FaceBoundaries(Mesh=clean_2)
weaver = Weaver(polylines=faceb, separation=number_slider_6)  # -> warp_2, weft_2
reb = RebuildCurve(Curve=weaver.warp_2, Count=params, Tangents=False)

# ---- group: Mesh previewer
mesh = Mesh(clean_2)
explode = MeshExplode(Mesh=mesh, Interpolate=False)
checkerboard = Checkerboard(Mesh=mesh)
dispatch = Dispatch(List=explode, DispatchPattern=checkerboard)  # -> ListA, ListB
preview = CustomPreview(Geometry=dispatch.ListA, Shader=ColourSwatch(SwatchColor=RGBA(0, 255, 102, 54)))
preview_2 = CustomPreview(Geometry=dispatch.ListB, Shader=ColourSwatch(SwatchColor=RGBA(255, 255, 255, 52)))

# ----
loop_end = LoopEnd(port=loop_start.port, Exit=False, Data=clean, pausedState=False, state="Constant & Record", TimeOutVal=0)

# ---- group: single-line weaverbird previewer
item = ListItem(List=weaver.weft_2, Index=Slider(10, range=0..10), Wrap=True)

# ---- group: Final Weaverbird result previewer
previewlw = CustomPreviewLineweights(Geometry=reb, Shader=ColourSwatch(SwatchColor=RGB(0, 119, 255)), Thickness=Slider(2, range=0..10), Absolute=False)

# ---- group: Browser
browse = BrowseHistory(Iteration=Slider(0, range=0..4), Data_0=loop_end)
panel_7 = Panel(browse)

# ----
panel_8 = Panel(loop_end)
final_mesh = Mesh(loop_end)
mjoin = MeshJoin(Meshes=flatten(final_mesh))

# ---- group: export and message sender
bake_step = PythonScript(curves=reb)  # -> isObjectBaked; inputs curves: list of Curve
# ---------- bake_step: Python ----------
import Rhino as rc
import scriptcontext as sc 
import rhinoscriptsyntax as rs

sc.doc = rc.RhinoDoc.ActiveDoc

for item in curves:
    rs.AddPipe(item, 0, 0.1)

sc.doc = ghdoc

isObjectBaked = True
# ---------- end bake_step ----------
directorypath_with_backslashes_no_spaces = Panel("C:\Users\patri\Desktop\braid-evolution\unity\interactive-braid-evolution\Assets\Geometry\test")  # "DirectoryPath with Backslashes NO SPACES and FileName Minus Extension"
export_step = PythonScript(FileNameToSave=directorypath_with_backslashes_no_spaces, shouldExport=bake_step)  # -> message
# ---------- export_step: Python ----------
import rhinoscriptsyntax
import Rhino

if(shouldExport == True):
    FILE_NAME = FileNameToSave
    
    rhinoscriptsyntax.Command("SelAll")
    rhinoscriptsyntax.Command("-Export " + FILE_NAME + ".obj y=n Enter Enter") #y=n turns off silly Y/Z axis swap! Use no spaces in the file path.
    rhinoscriptsyntax.Command("Delete Enter")
    
    message = True
else :
    message = False
# ---------- end export_step ----------
json_encoder = PythonScript(exportSucess=export_step)  # -> jsonString; inputs exportSucess: Boolean
# ---------- json_encoder: Python ----------
import json 



jsonString = json.dumps({
    'name': 'new_model', 
    'generation':'2', 
    'sucess': exportSucess
})
# ---------- end json_encoder ----------

# ----
bake_step_2 = PythonScript()  # -> isObjectBaked; inputs curves: list of Curve; same code as bake_step
directorypath_with_backslashes_no_spaces_2 = Panel("C:\Users\patri\Desktop\braid-evolution\unity\interactive-braid-evolution\Assets\Geometry\test")  # "DirectoryPath with Backslashes NO SPACES and FileName Minus Extension"
export_step_2 = PythonScript(FileNameToSave=directorypath_with_backslashes_no_spaces_2, shouldExport=bake_step_2)  # -> message; same code as export_step

# ---- group: export and message sender / Network configuration
ip_to_send_to = Panel("10.13.1.103")
port_to_send_to = Panel("8050")
udp_3 = UDPSender(Address=ip_to_send_to, Port=port_to_send_to, Pattern=0, Data=json_encoder)
panel_9 = Panel(udp_3)

# ----
json_encoder_2 = PythonScript(exportSucess=export_step_2)  # -> jsonString; inputs exportSucess: Boolean; same code as json_encoder

# ---- group: Network configuration
ip_to_send_to_2 = Panel("10.13.1.103")
port_to_send_to_2 = Panel("8050")
udp_4 = UDPSender(Address=ip_to_send_to_2, Port=port_to_send_to_2, Pattern=0, Data=json_encoder_2)
panel_10 = Panel(udp_4)

# ==== cluster Weaver
separation = ClusterInput()
polylines = ClusterInput()
polylines_2 = Data(polylines)
separation_2 = Data(separation)
disc = Discontinuity(Curve=reparameterize(polylines_2), Level=1)  # -> Points, Parameters
item = ListItem(List=disc.Points, Index=0, Wrap=True)  # -> Item, Item1, Item2, Item3
center = Average(Input=[item.Item, item.Item1, item.Item2, item.Item3])
pl_3pt = Plane3Pt(PointA=item.Item, PointB=item.Item1, PointC=item.Item3)
average = Average(Input=[item.Item3, item.Item])
average_2 = Average(Input=[item.Item1, item.Item2])
average_3 = Average(Input=[item.Item2, item.Item3])
average_4 = Average(Input=[item.Item, item.Item1])
deplane = DeconstructPlane(Plane=pl_3pt)  # -> Origin, XAxis, YAxis, ZAxis
center_2 = Average(Input=[average_4, center, average, item.Item])
center_3 = Average(Input=[item.Item2, average_2, average_3, center])
amp = Amplitude(Vector=deplane.ZAxis, Amplitude=separation_2)
rev = Reverse(Vector=amp)
move = Move(Geometry=center_2, Motion=rev)  # -> Geometry, Transform
move_2 = Move(Geometry=center_3, Motion=amp)  # -> Geometry, Transform
move_3 = Move(Geometry=center_2, Motion=amp)  # -> Geometry, Transform
move_4 = Move(Geometry=center_3, Motion=rev)  # -> Geometry, Transform
merge = Merge(Data1=average_4, Data2=move.Geometry, Data3=average)
merge_2 = Merge(Data1=average_2, Data2=move_2.Geometry, Data3=average_3)
merge_3 = Merge(Data1=item.Item, Data2=move_3.Geometry, Data3=center, Data4=move_4.Geometry, Data5=item.Item2)
intcrv = Interpolate(Vertices=merge, Degree=3, Periodic=False, KnotStyle=1)  # -> Curve, Length, Domain
intcrv_2 = Interpolate(Vertices=merge_3, Degree=3, Periodic=False, KnotStyle=1)  # -> Curve, Length, Domain
intcrv_3 = Interpolate(Vertices=merge_2, Degree=3, Periodic=False, KnotStyle=1)  # -> Curve, Length, Domain
join = JoinCurves(Curves=flatten(intcrv_2.Curve), Preserve=False)
join_2 = JoinCurves(Curves=flatten([intcrv_3.Curve, intcrv.Curve]), Preserve=False)
weft = Data(join)
warp = Data(join_2)
weft_2 = ClusterOutput(weft)
warp_2 = ClusterOutput(warp)
