# Grasshopper definition simple-cppn-experiment.gh (Grasshopper 0.9.76)
# plug-ins: Anemone, Octopus

# ---- group: Evolution Loop and NEAT configuration
panel = Panel("""SteepenedSigmoid .1

BipolarSigmoid .1

Gaussian .1

Linear .1

Sine .1

Cosine .1

Ramp .1

Spike .1

Step .1

Tangent .1

HyperbolicTangent .1

Modulus .1""")
loop_start = LoopStart(Repeat=0)  # -> port, Counter, Data
rn_octevolearn = RandomNetworkOEL(
    Inputs=Slider(2, range=0..10),
    Outputs=Slider(2, range=0..10),
    Functions=panel,
    Hidden=Slider(1, range=0..10),
    Seed=Slider(4, range=0..100))
neat_octevolearn = BreederOEL(
    Inputs=4,
    Outputs=2,
    Generations=Slider(0, range=0..10),
    Functions=["SteepenedSigmoid .1", "BipolarSigmoid .1", "Gaussian .1", "Linear .1", "Sine .1", "Cosine .1", "Ramp .1", "Spike .1", "Step .1", "Tangent .1", "HyperbolicTangent .1", "Modulus .1"],
    SeedNetworks=loop_start.Data,
    Run=False,
    dialogWindowSpawningOn=False,
    iterParameters_propagates_propagate0_class="Octopus.ghSharpNeatLib.Param_GH_Network, Octopus, Version=1.0.0.0, Culture=neutral, PublicKeyToken=null",
    iterParameters_propagates_propagate0_id="N",
    iterParameters_propagates_propagate0_numTargets=0,
    iterParameters_propagates_propagate1_class="Grasshopper.Kernel.Parameters.Param_Integer, Grasshopper, Version=1.0.0.20, Culture=neutral, PublicKeyToken=dda4f5ec2cd80803",
    iterParameters_propagates_propagate1_id="C",
    iterParameters_propagates_propagate1_numTargets=0,
    iterParameters_receivers_receiver0_class="Grasshopper.Kernel.Parameters.Param_Number, Grasshopper, Version=1.0.0.20, Culture=neutral, PublicKeyToken=dda4f5ec2cd80803",
    iterParameters_receivers_receiver0_id="Obj",
    iterParameters_receivers_receiver0_numTargets=0,
    iterParameters_receivers_receiver1_class="Grasshopper.Kernel.Parameters.Param_Number, Grasshopper, Version=1.0.0.20, Culture=neutral, PublicKeyToken=dda4f5ec2cd80803",
    iterParameters_receivers_receiver1_id="B",
    iterParameters_receivers_receiver1_numTargets=0,
    iterParameters_receivers_receiver2_class="Grasshopper.Kernel.Parameters.Param_GenericObject, Grasshopper, Version=1.0.0.20, Culture=neutral, PublicKeyToken=dda4f5ec2cd80803",
    iterParameters_receivers_receiver2_id="P",
    iterParameters_receivers_receiver2_numTargets=0,
    iterParameters_receivers_receiver3_class="Grasshopper.Kernel.Parameters.Param_Boolean, Grasshopper, Version=1.0.0.20, Culture=neutral, PublicKeyToken=dda4f5ec2cd80803",
    iterParameters_receivers_receiver3_id="Cons",
    iterParameters_receivers_receiver3_numTargets=0,
    iterParameters_receivers_receiver4_class="Grasshopper.Kernel.Parameters.Param_Boolean, Grasshopper, Version=1.0.0.20, Culture=neutral, PublicKeyToken=dda4f5ec2cd80803",
    iterParameters_receivers_receiver4_id="E",
    iterParameters_receivers_receiver4_numTargets=0,
    AutoRebuild_flag=True,
    EvaluationUnits_unit0_description="Evaluate Network Solutions",
    EvaluationUnits_unit0_name="Eval",
    EvaluationUnits_unit0_numControllers=2,
    EvaluationUnits_unit0_numPropagates=2,
    EvaluationUnits_unit0_numReceivers=5,
    EvaluationUnits_unit0_propagate0_id="N",
    EvaluationUnits_unit0_propagate1_id="C",
    EvaluationUnits_unit0_receiver0_id="Obj",
    EvaluationUnits_unit0_receiver1_id="B",
    EvaluationUnits_unit0_receiver2_id="P",
    EvaluationUnits_unit0_receiver3_id="Cons",
    EvaluationUnits_unit0_receiver4_id="E")  # -> EvolvedNetworks, FailedNetworks, Info, SavedNetworks
sn_octevolearn = ShowNetworkOEL(Network=rn_octevolearn)
loop_end = LoopEnd(
    port=loop_start.port,
    Exit=False,
    Data=neat_octevolearn.EvolvedNetworks,
    pausedState=False,
    state="Constant output",
    TimeOutVal=0)
