# Grasshopper definition single-braid-cita-processer_1.0.gh (Grasshopper 0.9.76)
# plug-ins: Python Interpreter, gHowl, Mesh Pipe, PolyMesh_GH

port_to_receive_on = Panel("8051")
ip_to_receive_on_this_computer = Panel("10.1.45.172")
udp = UDPReceiver(Address=ip_to_receive_on_this_computer, Port=port_to_receive_on, Pattern=0)  # -> Info, Data
panel = Panel(udp.Data)
panel_2 = Panel(udp.Info)
python = PythonScript(data=udp.Data)  # -> vector_list, id, out, debug, radius_list
# ---------- python: Python ----------
import json 
import Rhino.Geometry as r

j = json.loads(data)
out = []
debug = []
radius_list = []

id = j['braid']['id']

for vector_list in j['braid']['vectors2']: 
    temp = []
    for vector in vector_list: 
        #note, y and z swapped because reasons
        point = r.Point3d(vector['x'], vector['z'], vector['y'])
        temp.append(point)
        debug.append(point)
    out.append(r.Polyline(temp))
     
for radius_value in j['braid']['rad_values']: 
    radius_list.append(radius_value)
# ---------- end python ----------
panel_3 = Panel(python.radius_list)
panel_4 = Panel(python.debug)

explode = Explode(Curve=python.out, Recursive=True)  # -> Segments, Vertices
len = Length(Curve=explode.Segments)
multiplication = Multiplication(A=len, B=Slider(1.204, range=0..10))
divide = DivideCurve(Curve=explode.Segments, Count=multiplication, Kinks=False)  # -> Points, Tangents, Parameters
pshift = ShiftPaths(Data=divide.Points, Offset=-1)
pline = PolyLine(Vertices=pshift, Closed=False)
explode_2 = Explode(Curve=pline, Recursive=True)  # -> Segments, Vertices
shift = ShiftList(List=explode_2.Segments, Shift="-1", Wrap="false")
shift_2 = ShiftList(List=explode_2.Segments, Shift=1, Wrap="false")
rev = Reverse(Vector=shift)
end = EndPoints(Curve=shift)  # -> Start, End
xz = XZPlane(Origin=Point(0, 0, 0))
unit = UnitVector(Vector=rev)
unit_2 = UnitVector(Vector=shift_2)
angle = Angle(VectorA=unit, VectorB=unit_2, Plane=xz)  # -> Angle, Reflex
division = Division(A=angle.Reflex, B="2")
Y = UnitY(Factor=1)
vrot = Rotate(Vector=unit, Axis=Y, Angle=division)
Y_2 = UnitY(Factor=1)
pl = ConstructPlane(Origin=end.End, XAxis=vrot, YAxis=Y_2)
vdisex = VectorDisplayEx(Point=end.End, Vector=vrot, Colour=RGB(0, 0, 0), Width=2)

crv_cp = CurveClosestPoint(Point=explode_2.Vertices, Curve=reparameterize(pline))  # -> Point, Parameter, Distance
graph = GraphMapper(
    crv_cp.Parameter,
    x0=0,
    x1=1,
    y0=0,
    y1=1,
    container_name="Sine",
    Equation_px=[0.349930346, 0.0679718256],
    Equation_py=[0.3828987479, 0.5823187232])
shift_3 = ShiftList(List=graph, Shift="-1", Wrap="false")
shift_4 = ShiftList(List=shift_3, Shift=1, Wrap="false")

max_radius = Slider(0.5, range=0..1)
multiplication_2 = Multiplication(A=shift_4, B=max_radius)
python_2 = PythonScript(radius_values=python.radius_list, radius_segments=multiplication_2)  # -> out, a; inputs radius_values: list, radius_segments: list
# ---------- python_2: Python ----------
radius_segments[0] *= 2; 
a = radius_segments
# ---------- end python_2 ----------
num = Number(python.id)
directorypath_with_backslashes_no_spaces = Panel("C:\Users\pves\Desktop\braid-evolution\unity\interactive-braid-evolution\Assets\Geometry\Models\")  # "DirectoryPath with Backslashes NO SPACES and FileName Minus Extension"

cir = Circle(Plane=pl, Radius=multiplication_2)  # -> simplify(Circle)
divide_2 = DivideCurve(Curve=cir, Count=10, Kinks=False)  # -> Points, Tangents, Parameters
pline_2 = PolyLine(Vertices=divide_2.Points, Closed=True)
pshift_2 = ShiftPaths(Data=pline_2, Offset=-1)

clean = CleanTree(RemoveNulls=True, RemoveInvalid=True, RemoveEmpty=True, Tree=pshift_2)

vb = VBScript(x=clean, Reference="C:\Users\pves\AppData\Roaming\Grasshopper\Libraries\PolyMesh_Core.dll")  # -> out, A; inputs x: list of Polyline
# ---------- vb: C# ----------
    a = polymesh.LoftPolylines(x)
# ---------- end vb ----------
P = PolyMesh(vb.A)
getedges = GetEdges(PolyMesh=P)  # -> Edges, Naked
eval = EvaluateCurve(Curve=getedges.Edges, Parameter=".5")  # -> Point, Tangent, Angle
crv_cp_2 = CurveClosestPoint(Point=eval.Point, Curve=pline)  # -> Point, Parameter, Distance

# ---- group: Colors
bnd = Bounds(Numbers=flatten(multiplication_2))
remap = RemapNumbers(Value=crv_cp_2.Distance, Source=bnd, Target="1 to 2")  # -> Mapped, Clipped

# ----
weaver = Weaver(PolyMesh=P, Colors=remap.Mapped, Depth=0.1, Triangle=1, Type=2)
fjoin = FastJoin(Polylines=flatten(weaver))  # -> Polylines, Indices
mpipe = MeshPipe(
    Curve=fjoin.Polylines,
    Radius=Slider(0.03, range=0.01..1),
    Accuracy=0.2,
    Rotation=0,
    Segments=Slider(3, range=0..10),
    Caps=2)
lng = ListLength(List=mpipe)
demesh = DeconstructMesh(Mesh=mpipe)  # -> Vertices, Faces, Colours, Normals
random = Random(Range=Domain(0, 1), Number=lng, Seed=2)
hsl = ColourHSL(Alpha=1, Hue=random, Saturation=1, Luminance=0.5)
conmesh = ConstructMesh(Vertices=demesh.Vertices, Faces=demesh.Faces, Colours=graft(hsl))  # -> flatten(Mesh)
mjoin = MeshJoin(Meshes=conmesh)

panel_5 = Panel(weaver)
bake_step = PythonScript(mesh=mjoin)  # -> a; inputs mesh: Mesh
# ---------- bake_step: Python ----------
import Rhino as rc
import Rhino.Geometry as r
import scriptcontext as sc 
import rhinoscriptsyntax as rs

sc.doc = rc.RhinoDoc.ActiveDoc
#rs.AddMesh(mesh, mesh)
rc.RhinoDoc.ActiveDoc.Objects.AddMesh(mesh)
a = True
# ---------- end bake_step ----------
export_step = PythonScript(shouldExport=bake_step, path=directorypath_with_backslashes_no_spaces, id=num)  # -> should_export, id
# ---------- export_step: Python ----------
import rhinoscriptsyntax
import Rhino

#string = "C:\\Users\pves\\Desktop\\braid-evolution\\unity\\interactive-braid-evolution\\Assets\\Geometry\\Models\\"
FILE_NAME = path + "cita_braid_" + id.ToString()    
rhinoscriptsyntax.Command("SelAll")
rhinoscriptsyntax.Command("-Export " + FILE_NAME + ".obj y=n Enter Enter") #y=n turns off silly Y/Z axis swap! Use no spaces in the file path.
rhinoscriptsyntax.Command("Delete Enter")

should_export = True
# ---------- end export_step ----------
json_encoder = PythonScript(is_models_ready=export_step.should_export, id=export_step.id)  # -> jsonString; inputs is_models_ready: Boolean
# ---------- json_encoder: Python ----------
import json 

if is_models_ready: 
    jsonString = json.dumps({
        'should_import' : 1, 
        'id' : id
    })
# ---------- end json_encoder ----------
panel_6 = Panel(json_encoder)  # disabled

# ---- group: Network configuration
ip_to_send_to = Panel("10.1.45.172")
port_to_send_to = Panel("8050")
udp_2 = UDPSender(Address=ip_to_send_to, Port=port_to_send_to, Pattern=0, Data=json_encoder)
panel_7 = Panel(udp_2)
