# Grasshopper definition single-braid-processer_1.0.gh (Grasshopper 0.9.76)
# plug-ins: Python Interpreter, gHowl

# ---- group: Message reciever
ip_to_receive_on_this_computer = Panel("10.1.45.172")
port_to_receive_on = Panel("8051")
udp = UDPReceiver(Address=ip_to_receive_on_this_computer, Port=port_to_receive_on, Pattern=0)  # -> Info, Data
the_message_coming_from_unity = Panel(udp.Data)
panel = Panel(udp.Info)
json_loader = PythonScript(data=udp.Data)  # -> flatten(out), radius_list, id
# ---------- json_loader: Python ----------
import json 
import Rhino.Geometry as r

j = json.loads(data)
out = []
debug = []
radius_list = []

id = j['braid']['id']

for vector_list in j['braid']['vectors2']: 
    temp = []
    for vector in vector_list: 
        #note, y and z swapped because reasons
        point = r.Point3d(vector['x'], vector['z'], vector['y'])
        temp.append(point)
        debug.append(point)
    out.append(temp)
     
for radius_value in j['braid']['rad_values']: 
    radius_list.append(radius_value)
# ---------- end json_loader ----------

# ----
panel_2 = Panel(json_loader.out)
create_mesh_from_points = PythonScript(braid=json_loader.out, radius_list=json_loader.radius_list)  # -> mesh_list, a; inputs counter: Int32, braid: list, radius_list: list
# ---------- create_mesh_from_points: Python ----------
import Rhino as rc
import Rhino.Geometry as r
import scriptcontext as sc 
import rhinoscriptsyntax as rs

default_radius = 0.5
mesh_list = []
a = []
index = 0
radius_index = 0

for branch in braid: 
    while index < len(branch) - 1:
        startPoint = branch[index]
        endPoint = branch[index + 1]
        
        a.append(startPoint) 
        a.append(endPoint)
        
        line = r.Line(startPoint, endPoint)
        curve = r.LineCurve(line)
        
        ### PLANES AND CIRCLES ### : 
        planeBegin = r.Plane(line.From, r.Vector3d.Subtract( r.Vector3d(line.From),r.Vector3d(line.To)))
        planeEnd = r.Plane(line.To, r.Vector3d.Subtract( r.Vector3d(line.From),r.Vector3d(line.To)))
        
        circleBegin = r.Circle(planeBegin, radius_list[radius_index]).ToNurbsCurve()
        circleEnd = r.Circle(planeEnd, radius_list[radius_index + 1]).ToNurbsCurve() 
        
        #circleBegin = r.Circle(planeBegin, default_radius).ToNurbsCurve()
        #circleEnd = r.Circle(planeEnd, default_radius).ToNurbsCurve() 


        curveList = [circleBegin, circleEnd]
        
        ### BREPS AND MESHES ### : 
        brepSurfaces = r.Brep.CreateFromLoft(curveList, r.Point3d.Unset, r.Point3d.Unset, r.LoftType.Straight, False)    
        
        #TODO: This has 4x too many vertices and faces
        if(len(brepSurfaces) > 0):
            mesh = r.Mesh.CreateFromBrep(brepSurfaces[0], r.MeshingParameters.Minimal)
    
        mesh_list.append(mesh[0])
        radius_index += 1
        
        index += 1
    index = 0       


"""
for branch in braid: 
    while index < len(branch) - 1: 
        startPoint = r.Point3d(branch[index]['x'], branch[index]['y'], branch[index]['z'])
        endPoint = r.Point3d(branch[index + 1]['x'], branch[index + 1]['y'], branch[index + 1]['z'])
        
        a.append(startPoint) 
        a.append(endPoint)
        
        line = r.Line(startPoint, endPoint)
        curve = r.LineCurve(line)
          
        ### PLANES AND CIRCLES ### : 
        planeBegin = r.Plane(line.From, r.Vector3d.Subtract( r.Vector3d(line.From),r.Vector3d(line.To)))
        planeEnd = r.Plane(line.To, r.Vector3d.Subtract( r.Vector3d(line.From),r.Vector3d(line.To)))
        
        circleBegin = r.Circle(planeBegin, m_radius_list[radius_index]).ToNurbsCurve()
        circleEnd = r.Circle(planeEnd, m_radius_list[radius_index + 1]).ToNurbsCurve() 
        
        #circleBegin = r.Circle(planeBegin, default_radius).ToNurbsCurve()
        #circleEnd = r.Circle(planeEnd, default_radius).ToNurbsCurve() 


        curveList = [circleBegin, circleEnd]
        
        ### BREPS AND MESHES ### : 
        brepSurfaces = r.Brep.CreateFromLoft(curveList, r.Point3d.Unset, r.Point3d.Unset, r.LoftType.Straight, False)    
        
        #TODO: This has 4x too many vertices and faces
        if(len(brepSurfaces) > 0):
            mesh = r.Mesh.CreateFromBrep(brepSurfaces[0], r.MeshingParameters.Minimal)
    
        mesh_list.append(mesh[0])
        radius_index += 1
        
        index += 1
    index = 0       
    """
# ---------- end create_mesh_from_points ----------
hardcoded_perfect_vectors = Panel("""{0,0,0}
{0,0,2}
{0,0,4}
{0,0,6}
{0,0,8}
{2,0,10}""")
mesh = Mesh(create_mesh_from_points.mesh_list)
num = Number(json_loader.id)
python = PythonScript(mesh=mesh)  # -> a; inputs mesh: Mesh, x: Boolean
# ---------- python: Python ----------
import Rhino as rc
import scriptcontext as sc 
import rhinoscriptsyntax as rs


rc.RhinoDoc.ActiveDoc.Objects.AddMesh(mesh)
a = True
# ---------- end python ----------

# ---- group: Export and braidify step
faceb = FaceBoundaries()
params = Slider(3, range=0..100)
weaver = Weaver(polylines=faceb, separation=Slider(0.01, range=0..1))  # -> warp_2, weft_2
reb = RebuildCurve(Curve=weaver.warp_2, Count=params, Tangents=False)
bake_step = PythonScript(curves=reb, toggle=Toggle(True))  # -> c, isObjectBaked; inputs curves: list of Curve
# ---------- bake_step: Python ----------
import Rhino as rc
import scriptcontext as sc 
import rhinoscriptsyntax as rs

sc.doc = rc.RhinoDoc.ActiveDoc

if toggle: 
    for item in curves:
        rs.AddPipe(item, 0, 0.1)

sc.doc = ghdoc

isObjectBaked = True

c = curves
# ---------- end bake_step ----------

# ----
directorypath_with_backslashes_no_spaces = Panel("C:\Users\pves\Desktop\braid-evolution\unity\interactive-braid-evolution\Assets\Geometry\Models\")  # "DirectoryPath with Backslashes NO SPACES and FileName Minus Extension"
export_step = PythonScript(id=num, path=directorypath_with_backslashes_no_spaces, shouldExport=python)  # -> message
# ---------- export_step: Python ----------
import rhinoscriptsyntax
import Rhino
import json 

#string = "C:\\Users\pves\\Desktop\\braid-evolution\\unity\\interactive-braid-evolution\\Assets\\Geometry\\Models\\"
FILE_NAME = path + "braid_" + id.ToString()    
rhinoscriptsyntax.Command("SelAll")
rhinoscriptsyntax.Command("-Export " + FILE_NAME + ".obj y=n Enter Enter") #y=n turns off silly Y/Z axis swap! Use no spaces in the file path.
rhinoscriptsyntax.Command("Delete Enter")

sendMessage = True
# ---------- end export_step ----------
python_2 = PythonScript(id=num)  # -> out, message
# ---------- python_2: Python ----------
import json 

message = json.dumps({
    'should_import' : 1, 
    'id' : id
})
# ---------- end python_2 ----------
panel_3 = Panel(python_2.message)

# ---- group: Network configuration
ip_to_send_to = Panel("10.1.45.172")
port_to_send_to = Panel("8050")
udp_2 = UDPSender(Address=ip_to_send_to, Port=port_to_send_to, Pattern=0, Data=python_2.message)
panel_4 = Panel(udp_2)

# ==== cluster Weaver
separation = ClusterInput()
polylines = ClusterInput()
polylines_2 = Data(polylines)
separation_2 = Data(separation)
disc = Discontinuity(Curve=reparameterize(polylines_2), Level=1)  # -> Points, Parameters
item = ListItem(List=disc.Points, Index=0, Wrap=True)  # -> Item, Item1, Item2, Item3
center = Average(Input=[item.Item, item.Item1, item.Item2, item.Item3])
average = Average(Input=[item.Item3, item.Item])
pl_3pt = Plane3Pt(PointA=item.Item, PointB=item.Item1, PointC=item.Item3)
average_2 = Average(Input=[item.Item1, item.Item2])
average_3 = Average(Input=[item.Item2, item.Item3])
average_4 = Average(Input=[item.Item, item.Item1])
deplane = DeconstructPlane(Plane=pl_3pt)  # -> Origin, XAxis, YAxis, ZAxis
center_2 = Average(Input=[average_4, center, average, item.Item])
center_3 = Average(Input=[item.Item2, average_2, average_3, center])
amp = Amplitude(Vector=deplane.ZAxis, Amplitude=separation_2)
rev = Reverse(Vector=amp)
move = Move(Geometry=center_2, Motion=rev)  # -> Geometry, Transform
move_2 = Move(Geometry=center_3, Motion=amp)  # -> Geometry, Transform
move_3 = Move(Geometry=center_2, Motion=amp)  # -> Geometry, Transform
move_4 = Move(Geometry=center_3, Motion=rev)  # -> Geometry, Transform
merge = Merge(Data1=average_4, Data2=move.Geometry, Data3=average)
merge_2 = Merge(Data1=average_2, Data2=move_2.Geometry, Data3=average_3)
merge_3 = Merge(Data1=item.Item, Data2=move_3.Geometry, Data3=center, Data4=move_4.Geometry, Data5=item.Item2)
intcrv = Interpolate(Vertices=merge, Degree=3, Periodic=False, KnotStyle=1)  # -> Curve, Length, Domain
intcrv_2 = Interpolate(Vertices=merge_3, Degree=3, Periodic=False, KnotStyle=1)  # -> Curve, Length, Domain
intcrv_3 = Interpolate(Vertices=merge_2, Degree=3, Periodic=False, KnotStyle=1)  # -> Curve, Length, Domain
join = JoinCurves(Curves=flatten(intcrv_2.Curve), Preserve=False)
join_2 = JoinCurves(Curves=flatten([intcrv_3.Curve, intcrv.Curve]), Preserve=False)
weft = Data(join)
warp = Data(join_2)
weft_2 = ClusterOutput(weft)
warp_2 = ClusterOutput(warp)
