# Grasshopper definition tutorial-file.gh (Grasshopper 0.9.76)

# ---- group: 20-22: Panelization, Subdivided flat panel, and curve reversing
brep = Brep(<brep referenced from the Rhino model>)
divide = DivideDomain²(Domain=brep, UCount=Slider(6, range=0..10), VCount=Slider(4, range=0..10))
subsrf = Isotrim(Surface=brep, Domain=divide)
number_slider = Slider(3, range=0..3)
debrep = DeconstructBrep(Brep=subsrf)  # -> Faces, Edges, Vertices
srfgrid = SurfaceFromPoints(Points=debrep.Vertices, UCount=Slider(2, range=0..5), Interpolate=False)
item = ListItem(List=debrep.Edges, Index=number_slider, Wrap=True)
item_2 = ListItem(List=debrep.Edges, Index=[number_slider, Slider(1, range=0..3)], Wrap=True)
flip = FlipCurve(Curve=item)  # -> Curve, Flag
rulesrf = RuledSurface(CurveA=item_2, CurveB=flip.Curve)
area = Area(Geometry=rulesrf)  # -> Area, Centroid
srf_cp = SurfaceClosestPoint(Point=area.Centroid, Surface=rulesrf)  # -> Point, UVPoint, Distance
evalsrf = EvaluateSurface(Surface=rulesrf, Point=srf_cp.UVPoint)  # -> Point, Normal, Frame
polygon = Polygon(Plane=evalsrf.Frame, Radius=Slider(1, range=0..5), Segments=6, FilletRadius=0)  # -> Polygon, Length

# ---- group: 16 - 18: Surface construction, Subdivision and Breb deconstructing
crv = Curve(<curve referenced from the Rhino model>)
crv_2 = Curve(<curve referenced from the Rhino model>)
srf = Surface(crv)
srf_2 = Surface(<surface referenced from the Rhino model>)
srf_3 = Surface(crv_2)
divide_2 = DivideDomain²(Domain=srf_2, UCount=Slider(6, range=0..10), VCount=Slider(10, range=0..10))
divide_3 = DivideDomain²(Domain=srf, UCount=Slider(6, range=0..10), VCount=Slider(7, range=0..10))
subsrf_2 = Isotrim(Surface=srf_2, Domain=divide_2)
subsrf_3 = Isotrim(Surface=srf, Domain=divide_3)
debrep_2 = DeconstructBrep(Brep=subsrf_2)  # -> Faces, Edges, Vertices
area_2 = Area(Geometry=debrep_2.Faces)  # -> Area, Centroid
srf_cp_2 = SurfaceClosestPoint(Point=area_2.Centroid, Surface=debrep_2.Faces)  # -> Point, UVPoint, Distance
evalsrf_2 = EvaluateSurface(Surface=debrep_2.Faces, Point=srf_cp_2.UVPoint)  # -> Point, Normal, Frame
polygon_2 = Polygon(Plane=evalsrf_2.Frame, Radius=3, Segments=6, FilletRadius=0)  # -> Polygon, Length

# ---- group: Polygon grid
number_slider_2 = Slider(1, range=0..10)
division = Division(A=number_slider_2, B="2")
sqgrid = Square(Plane=PlaneXY(0, 0, 0), Size=number_slider_2, ExtentX=Slider(7, range=0..10), ExtentY=Slider(8, range=0..10))  # -> Cells, Points
polygon_3 = Polygon(Plane=sqgrid.Points, Radius=division, Segments=Slider(3, range=3..8), FilletRadius=0)  # -> Polygon, Length

# ----
yz = YZPlane(Origin=Point(0, 0, 0))

# ---- group: Polygon grid
size = Slider(1, range=0..10)
division_2 = Division(A=size, B="2")
sqgrid_2 = Square(Plane=yz, Size=size, ExtentX=Slider(7, range=0..10), ExtentY=Slider(8, range=0..10))  # -> Cells, Points
polygon_4 = Polygon(Plane=sqgrid_2.Points, Radius=division_2, Segments=Slider(3, range=3..8), FilletRadius=0)  # -> Polygon, Length

# ---- group: 19: 2D Perforated Surface with Solid difference
number_slider_3 = Slider(7, range=0..10)
number_slider_4 = Slider(6, range=0..10)
srf_4 = Surface(<surface referenced from the Rhino model>)
srf_5 = Surface(<surface referenced from the Rhino model>)

# ---- group: 19: 2D Perforated Surface with Solid difference / Srf > Util
sdivide = DivideSurface(Surface=srf_4, UCount=number_slider_4, VCount=number_slider_3)  # -> Points, Normals, Parameters

# ---- group: 19: 2D Perforated Surface with Solid difference (continued)
cir = Circle(Plane=sdivide.Points, Radius=Slider(0.2, range=0..10))
srf_6 = Surface(cir)
sdiff = SolidDifference(BrepsA=srf_5, BrepsB=flatten(srf_6))

# ---- group: Basic modelling
number_slider_5 = Slider(0, range=0..10)
panel = Panel("2")
pt = Point(<point referenced from the Rhino model>)
number_slider_6 = Slider(7.5, range=0..10)

pt_2 = ConstructPoint(XCoordinate=number_slider_6, YCoordinate=number_slider_6, ZCoordinate=number_slider_6)
division_3 = Division(A=number_slider_6, B=panel)
pt_3 = ConstructPoint(XCoordinate=number_slider_5, YCoordinate=number_slider_5, ZCoordinate=number_slider_5)
pdecon = Deconstruct(Point=pt)  # -> XComponent, YComponent, ZComponent
addition = Addition(A=division_3, B=pdecon.XComponent)
addition_2 = Addition(A=division_3, B=pdecon.YComponent)
addition_3 = Addition(A=division_3, B=pdecon.ZComponent)
pt_4 = ConstructPoint(XCoordinate=addition, YCoordinate=addition_2, ZCoordinate=addition_3)
box = Box2Pt(PointA=pt, PointB=pt_4, Plane=PlaneXY(0, 0, 0))
box_2 = Box2Pt(PointA=pt_3, PointB=pt_2, Plane=PlaneXY(0, 0, 0))

mcol = MeshColours(Mesh=box_2, Colours=ColourSwatch(SwatchColor=RGB(255, 255, 255)))

# ---- group: Rectangle Gradient Grid
number_slider_7 = Slider(8, range=0..10)
number_slider_8 = Slider(1, range=0..10)
number_slider_9 = Slider(8, range=0..10)
number_slider_10 = Slider(6, range=0..10)
number_slider_11 = Slider(5, range=0..10)
number_slider_12 = Slider(3, range=0..10)
neg = Negative(Value=number_slider_8)
neg_2 = Negative(Value=number_slider_12)
number_slider_13 = Slider(0.05, range=0..1.5)
number_slider_14 = Slider(1.5, range=0..1.5)

# ---- group: Rectangle Gradient Grid / Vect > Grid
recgrid = Rectangular(Plane=PlaneXY(0, 0, 0), SizeX=number_slider_9, SizeY=number_slider_10, ExtentX=number_slider_11, ExtentY=number_slider_7)  # -> Cells, flatten(Points)

# ---- group: Rectangle Gradient Grid / Math > Dom
dom = ConstructDomain(DomainStart=neg_2, DomainEnd=number_slider_12)

dom_2 = ConstructDomain(DomainStart=neg, DomainEnd=number_slider_8)

# ---- group: Rectangle Gradient Grid (continued)
lng = ListLength(List=flatten(recgrid.Points))
rectangle = Rectangle(Plane=recgrid.Points, XSize=dom, YSize=dom_2, Radius=0)  # -> Rectangle, Length

# ----
dom_3 = ConstructDomain(DomainStart=number_slider_13, DomainEnd=number_slider_14)

# ---- group: Rectangle Gradient Grid / Set > Seq
range = Range(Domain=dom_3, Steps=lng)

# ---- group: Rectangle Gradient Grid / Trans > Affine
scale = Scale(Geometry=rectangle.Rectangle, Center=recgrid.Points, Factor=range)  # -> Geometry, Transform

# ---- group: Element Isolation Part 1
srf_7 = Surface(scale.Geometry)
number_slider_15 = Slider(0.15, range=0..0.55)
number_slider_16 = Slider(2, range=0..3)
panel_2 = Panel("2")
Z = UnitZ(Factor=Slider(3, range=0..10))

# ---- group: Element Isolation Part 1 / Srf > analysis
debrep_3 = DeconstructBrep(Brep=srf_7)  # -> Faces, Edges, Vertices

# ---- group: Element Isolation Part 1 / Srf > Freeform
pipe = Pipe(Curve=debrep_3.Edges, Radius=number_slider_15, Caps=panel_2)

# ---- group: Element Isolation Part 1 / Set > List
item_3 = ListItem(List=debrep_3.Edges, Index=number_slider_16, Wrap=True)

# ---- group: Element Isolation Part 1 / Srf > Frfm
extr = Extrude(Base=item_3, Direction=Z)
