# Grasshopper definition udp.gh (Grasshopper 0.9.76)
# plug-ins: MeshEdit Components, Python Interpreter, Human, Kangaroo Components, gHowl, Octopus

# ---- group: Approach 1 for splitting a braid: Creates two symmetric braid ending points that has the same origin
Z = UnitZ(Factor=1)
Y = UnitY(Factor=1)  # -> expr("-x", UnitVector)
Z_2 = UnitZ(Factor=1)
Y_2 = UnitY(Factor=1)
addition = Addition(A=Y, B=Z)
move = Move(Motion=addition)  # -> Geometry, Transform
addition_2 = Addition(A=Y_2, B=Z_2)
move_2 = Move(Motion=Vector(0, 0, 10))  # -> Geometry, Transform

# ---- group: Message reciever
ip_to_receive_on_this_computer = Panel("10.13.1.103")
port_to_receive_on = Panel("8051")
udp = UDPReceiver(Address=ip_to_receive_on_this_computer, Port=port_to_receive_on, Pattern=0)  # -> Info, Data
the_message_coming_from_unity = Panel(udp.Data)
panel = Panel(udp.Info)
json_loader = PythonScript(data=udp.Data)  # -> height, dictValues, dictObject
# ---------- json_loader: Python ----------
import json 

if(bool(data)): 
    j = json.loads(data)
    dictValues = []

    for item in j:
        dictValues.append(j[item])
        
    height = j['height']        
else: 
    height = 1
#if(bool(j)): #Empty dict evaluates to false in python
   #shouldExport = True

#dictObject = j
# ---------- end json_loader ----------
panel_2 = Panel(json_loader.dictObject)
panel_3 = Panel(json_loader.dictValues)

# ---- group: Base point
pt = ConstructPoint(XCoordinate=0, YCoordinate=0, ZCoordinate=0)

# ----
Y_3 = Slider(3, range=0..10)
Z_3 = Slider(7, range=0..10)
Z_4 = UnitZ(Factor=json_loader.height)

# ---- group: Sub division point
move_3 = Move(Geometry=pt, Motion=Z_4)  # -> Geometry, Transform

# ---- group: Create split point
Y_4 = UnitY(Factor=Y_3)
Z_5 = UnitZ(Factor=Z_3)
addition_3 = Addition(A=Y_4, B=Z_5)
move_4 = Move(Geometry=move_3.Geometry, Motion=addition_3)  # -> Geometry, Transform

# ----
Y_5 = UnitY(Factor=Y_3)  # -> expr("-x", UnitVector)
Z_6 = UnitZ(Factor=Z_3)
addition_4 = Addition(A=Y_5, B=Z_6)
move_5 = Move(Geometry=move_3.Geometry, Motion=addition_4)  # -> Geometry, Transform
ln = Line(StartPoint=pt, EndPoint=move_3.Geometry)
ln_2 = Line(StartPoint=move_3.Geometry, EndPoint=move_5.Geometry)

# ---- group: Params deciding the "curve" geometry
number_slider = Slider(0.2, range=0..1)
number_slider_2 = Slider(1, range=0..1)
number_slider_3 = Slider(0, range=0..1)
number_slider_4 = Slider(1, range=0..1)

# ----
eval = EvaluateCurve(Curve=reparameterize(ln), Parameter=[number_slider_3, number_slider_4])  # -> Point, Tangent, Angle
eval_2 = EvaluateCurve(Curve=reparameterize(ln_2), Parameter=[number_slider, number_slider_2])  # -> Point, Tangent, Angle
number_slider_5 = Slider(1, range=0..1)

# ---- group: Mesh step 1: Create circle and loft it based on two points
ln_3 = Line(StartPoint=move_3.Geometry, EndPoint=move_4.Geometry)
eval_3 = EvaluateCurve(Curve=reparameterize(ln_3), Parameter=[number_slider, number_slider_2])  # -> Point, Tangent, Angle
circle = CircleCNR(Center=eval_3.Point, Normal=ln_3, Radius=expr("x/2", number_slider_5))
loft = Loft(Curves=circle, Options={Adjust=False, Closed=False, LoftEnds=0, LoftSimp=0, LoftType=0, Rebuild=10, Refit=0.01})

# ----
circle_2 = CircleCNR(Center=eval_2.Point, Normal=ln_2, Radius=expr("x/2", number_slider_5))
circle_3 = CircleCNR(Center=eval.Point, Normal=ln, Radius=number_slider_5)
loft_2 = Loft(Curves=circle_2, Options={Adjust=False, Closed=False, LoftEnds=0, LoftSimp=0, LoftType=0, Rebuild=10, Refit=0.01})
loft_3 = Loft(Curves=circle_3, Options={Adjust=False, Closed=False, LoftEnds=0, LoftSimp=0, LoftType=0, Rebuild=10, Refit=0.01})
number_slider_6 = Slider(4, range=0..10)
number_slider_7 = Slider(8, range=0..20)

# ---- group: Mesh step 2: Create mesh surface from "lofted circle"
mesh_uv = MeshSurface(Surface=loft, UCount=number_slider_6, VCount=expr("x/2", number_slider_7), Overhang=True, Equalize=False)
clean = CombineClean(Meshes=mesh_uv)
medges = MeshEdges(Mesh=clean)  # -> NakedEdges, InteriorEdges, NonManifoldEdges
join = JoinCurves(Curves=medges.NakedEdges, Preserve=False)
item = ListItem(List=join, Index=1, Wrap=True)

# ----
mesh_uv_2 = MeshSurface(Surface=loft_2, UCount=number_slider_6, VCount=expr("x/2", number_slider_7), Overhang=True, Equalize=False)
mesh_uv_3 = MeshSurface(Surface=loft_3, UCount=Slider(4, range=0..10), VCount=number_slider_7, Overhang=True, Equalize=False)
clean_2 = CombineClean(Meshes=mesh_uv_3)
clean_3 = CombineClean(Meshes=mesh_uv_2)
medges_2 = MeshEdges(Mesh=clean_2)  # -> NakedEdges, InteriorEdges, NonManifoldEdges
medges_3 = MeshEdges(Mesh=clean_3)  # -> NakedEdges, InteriorEdges, NonManifoldEdges
join_2 = JoinCurves(Curves=medges_2.NakedEdges, Preserve=False)
join_3 = JoinCurves(Curves=medges_3.NakedEdges, Preserve=False)
item_2 = ListItem(List=join_2, Index=1, Wrap=True)
item_3 = ListItem(List=join_3, Index=0, Wrap=True)
explode = Explode(Curve=item_2, Recursive=True)  # -> Segments, Vertices
explode_2 = Explode(Curve=item_3, Recursive=True)  # -> Segments, Vertices
shift = ShiftList(List=explode_2.Segments, Shift=Slider(3, range=0..10), Wrap=True)  # -> simplify(graft(List))
lng = ListLength(List=explode.Segments)
split = SplitList(List=explode.Segments, Index=expr("x/2", lng))  # -> simplify(graft(ListA)), simplify(graft(ListB))

# ---- group: Create attachble mesh that can combine two braid segments
explode_3 = Explode(Curve=item, Recursive=True)  # -> Segments, Vertices
shift_2 = ShiftList(List=explode_3.Segments, Shift=Slider(1, range=0..10), Wrap=True)  # -> simplify(graft(List))
loft_4 = Loft(
    Curves=simplify([shift_2, split.ListB]),
    Options={Adjust=False, Closed=False, LoftEnds=0, LoftSimp=0, LoftType=0, Rebuild=10, Refit=0.01})
smesh = SimpleMesh(Brep=flatten(loft_4))

# ----
loft_5 = Loft(
    Curves=simplify([split.ListA, shift]),
    Options={Adjust=False, Closed=False, LoftEnds=0, LoftSimp=0, LoftType=0, Rebuild=10, Refit=0.01})
smesh_2 = SimpleMesh(Brep=flatten(loft_5))
clean_4 = CombineClean(Meshes=[smesh, smesh_2, clean, clean_2, clean_3])
md = MeshDirection(Mesh=clean_4)
preview = CustomPreview(Geometry=clean_4, Shader=ColourSwatch(SwatchColor=RGBA(255, 255, 255, 28)))
turn = MeshTurn(Mesh=md)
mesh = Mesh(turn)

# ---- group: Braidifying the Mesh
md_2 = MeshDirection(Mesh=mesh)
mesh_2 = Mesh(md_2)
number_slider_8 = Slider(0.05, range=0..1)
faceb = FaceBoundaries(Mesh=md_2)
geo = Geometry(<curve referenced from the Rhino model>)
weaver = Weaver(polylines=geo, separation=number_slider_8)  # -> warp_2, weft_2
weaver_2 = Weaver(polylines=faceb, separation=number_slider_8)  # -> warp_2, weft_2
number_slider_9 = Slider(21, range=0..100)
toggle = BooleanToggle(True)
explode_4 = MeshExplode(Mesh=mesh_2, Interpolate=False)
checkerboard = Checkerboard(Mesh=mesh_2)
item_4 = ListItem(List=weaver_2.weft_2, Index=Slider(10, range=0..10), Wrap=True)
reb = RebuildCurve(Curve=weaver_2.warp_2, Count=number_slider_9, Tangents=toggle)
dispatch = Dispatch(List=explode_4, DispatchPattern=checkerboard)  # -> ListA, ListB
reb_2 = RebuildCurve(Curve=weaver_2.weft_2, Degree=Slider(10, range=0..10), Count=number_slider_9, Tangents=toggle)
number_slider_10 = Slider(2, range=0..10)
preview_2 = CustomPreview(Geometry=dispatch.ListB, Shader=ColourSwatch(SwatchColor=RGBA(255, 255, 255, 52)))
preview_3 = CustomPreview(Geometry=dispatch.ListA, Shader=ColourSwatch(SwatchColor=RGBA(0, 255, 102, 54)))
previewlw = CustomPreviewLineweights(Geometry=reb, Shader=ColourSwatch(SwatchColor=RGB(0, 119, 255)), Thickness=number_slider_10, Absolute=False)
previewlw_2 = CustomPreviewLineweights(Geometry=reb_2, Shader=ColourSwatch(SwatchColor=RGB(255, 94, 0)), Thickness=number_slider_10, Absolute=False)

# ---- group: export and message sender
bake_step = PythonScript(curves=reb)  # -> isObjectBaked; inputs curves: list of Curve
# ---------- bake_step: Python ----------
import Rhino as rc
import scriptcontext as sc 
import rhinoscriptsyntax as rs

sc.doc = rc.RhinoDoc.ActiveDoc

#for item in curves:
    #rs.AddPipe(item, 0, 0.1)

sc.doc = ghdoc

isObjectBaked = True
# ---------- end bake_step ----------
directorypath_with_backslashes_no_spaces = Panel("C:\Users\patri\Desktop\braid-evolution\unity\interactive-braid-evolution\Assets\Geometry\test")  # "DirectoryPath with Backslashes NO SPACES and FileName Minus Extension"
export_step = PythonScript(FileNameToSave=directorypath_with_backslashes_no_spaces, shouldExport=bake_step)  # -> message
# ---------- export_step: Python ----------
import rhinoscriptsyntax
import Rhino

shouldExport = False 

if(shouldExport == True):
    FILE_NAME = FileNameToSave
    
    rhinoscriptsyntax.Command("SelAll")
    rhinoscriptsyntax.Command("-Export " + FILE_NAME + ".obj y=n Enter Enter") #y=n turns off silly Y/Z axis swap! Use no spaces in the file path.
    rhinoscriptsyntax.Command("Delete Enter")
    
    message = True
else :
    message = False
# ---------- end export_step ----------
json_encoder = PythonScript(exportSucess=export_step)  # -> jsonString; inputs exportSucess: Boolean
# ---------- json_encoder: Python ----------
import json 



jsonString = json.dumps({
    'name': 'new_model', 
    'generation':'2', 
    'sucess': exportSucess
})
# ---------- end json_encoder ----------

# ----
pipe = Pipe(Curve=reb, Radius=Slider(0.2, range=0..2), Caps=0)

# ---- group: export and message sender / Network configuration
ip_to_send_to = Panel("10.13.1.103")
port_to_send_to = Panel("8050")
udp_2 = UDPSender(Address=ip_to_send_to, Port=port_to_send_to, Pattern=0, Data=json_encoder)
panel_4 = Panel(udp_2)

# ----
panel_5 = Panel("""SteepenedSigmoid .1

BipolarSigmoid .1

Gaussian .1

Linear .1

Sine .1

Cosine .1

Ramp .1

Spike .1

Step .1

Tangent .1

HyperbolicTangent .1

Modulus .1""")
rn_octevolearn = RandomNetworkOEL(
    Inputs=Slider(2, range=0..10),
    Outputs=Slider(2, range=0..10),
    Functions=panel_5,
    Hidden=Slider(1, range=0..10),
    Seed=Slider(4, range=0..100))
neat_octevolearn = BreederOEL(
    Inputs=4,
    Outputs=2,
    Generations=Slider(0, range=0..10),
    Functions=["SteepenedSigmoid .1", "BipolarSigmoid .1", "Gaussian .1", "Linear .1", "Sine .1", "Cosine .1", "Ramp .1", "Spike .1", "Step .1", "Tangent .1", "HyperbolicTangent .1", "Modulus .1"],
    Run=False,
    dialogWindowSpawningOn=False,
    iterParameters_propagates_propagate0_class="Octopus.ghSharpNeatLib.Param_GH_Network, Octopus, Version=1.0.0.0, Culture=neutral, PublicKeyToken=null",
    iterParameters_propagates_propagate0_id="N",
    iterParameters_propagates_propagate0_numTargets=0,
    iterParameters_propagates_propagate1_class="Grasshopper.Kernel.Parameters.Param_Integer, Grasshopper, Version=1.0.0.20, Culture=neutral, PublicKeyToken=dda4f5ec2cd80803",
    iterParameters_propagates_propagate1_id="C",
    iterParameters_propagates_propagate1_numTargets=0,
    iterParameters_receivers_receiver0_class="Grasshopper.Kernel.Parameters.Param_Number, Grasshopper, Version=1.0.0.20, Culture=neutral, PublicKeyToken=dda4f5ec2cd80803",
    iterParameters_receivers_receiver0_id="Obj",
    iterParameters_receivers_receiver0_numTargets=0,
    iterParameters_receivers_receiver1_class="Grasshopper.Kernel.Parameters.Param_Number, Grasshopper, Version=1.0.0.20, Culture=neutral, PublicKeyToken=dda4f5ec2cd80803",
    iterParameters_receivers_receiver1_id="B",
    iterParameters_receivers_receiver1_numTargets=0,
    iterParameters_receivers_receiver2_class="Grasshopper.Kernel.Parameters.Param_GenericObject, Grasshopper, Version=1.0.0.20, Culture=neutral, PublicKeyToken=dda4f5ec2cd80803",
    iterParameters_receivers_receiver2_id="P",
    iterParameters_receivers_receiver2_numTargets=0,
    iterParameters_receivers_receiver3_class="Grasshopper.Kernel.Parameters.Param_Boolean, Grasshopper, Version=1.0.0.20, Culture=neutral, PublicKeyToken=dda4f5ec2cd80803",
    iterParameters_receivers_receiver3_id="Cons",
    iterParameters_receivers_receiver3_numTargets=0,
    iterParameters_receivers_receiver4_class="Grasshopper.Kernel.Parameters.Param_Boolean, Grasshopper, Version=1.0.0.20, Culture=neutral, PublicKeyToken=dda4f5ec2cd80803",
    iterParameters_receivers_receiver4_id="E",
    iterParameters_receivers_receiver4_numTargets=0,
    AutoRebuild_flag=True,
    EvaluationUnits_unit0_description="Evaluate Network Solutions",
    EvaluationUnits_unit0_name="Eval",
    EvaluationUnits_unit0_numControllers=2,
    EvaluationUnits_unit0_numPropagates=2,
    EvaluationUnits_unit0_numReceivers=5,
    EvaluationUnits_unit0_propagate0_id="N",
    EvaluationUnits_unit0_propagate1_id="C",
    EvaluationUnits_unit0_receiver0_id="Obj",
    EvaluationUnits_unit0_receiver1_id="B",
    EvaluationUnits_unit0_receiver2_id="P",
    EvaluationUnits_unit0_receiver3_id="Cons",
    EvaluationUnits_unit0_receiver4_id="E")  # -> EvolvedNetworks, FailedNetworks, Info, SavedNetworks
sn_octevolearn = ShowNetworkOEL(Network=rn_octevolearn)
panel_6 = Panel(neat_octevolearn.Info)

# ==== cluster Weaver
separation = ClusterInput()
polylines = ClusterInput()
polylines_2 = Data(polylines)
separation_2 = Data(separation)
disc = Discontinuity(Curve=reparameterize(polylines_2), Level=1)  # -> Points, Parameters
item = ListItem(List=disc.Points, Index=0, Wrap=True)  # -> Item, Item1, Item2, Item3
center = Average(Input=[item.Item, item.Item1, item.Item2, item.Item3])
pl_3pt = Plane3Pt(PointA=item.Item, PointB=item.Item1, PointC=item.Item3)
average = Average(Input=[item.Item3, item.Item])
average_2 = Average(Input=[item.Item1, item.Item2])
average_3 = Average(Input=[item.Item2, item.Item3])
average_4 = Average(Input=[item.Item, item.Item1])
deplane = DeconstructPlane(Plane=pl_3pt)  # -> Origin, XAxis, YAxis, ZAxis
center_2 = Average(Input=[average_4, center, average, item.Item])
center_3 = Average(Input=[item.Item2, average_2, average_3, center])
amp = Amplitude(Vector=deplane.ZAxis, Amplitude=separation_2)
rev = Reverse(Vector=amp)
move = Move(Geometry=center_2, Motion=rev)  # -> Geometry, Transform
move_2 = Move(Geometry=center_3, Motion=amp)  # -> Geometry, Transform
move_3 = Move(Geometry=center_2, Motion=amp)  # -> Geometry, Transform
move_4 = Move(Geometry=center_3, Motion=rev)  # -> Geometry, Transform
merge = Merge(Data1=average_4, Data2=move.Geometry, Data3=average)
merge_2 = Merge(Data1=average_2, Data2=move_2.Geometry, Data3=average_3)
merge_3 = Merge(Data1=item.Item, Data2=move_3.Geometry, Data3=center, Data4=move_4.Geometry, Data5=item.Item2)
intcrv = Interpolate(Vertices=merge, Degree=3, Periodic=False, KnotStyle=1)  # -> Curve, Length, Domain
intcrv_2 = Interpolate(Vertices=merge_3, Degree=3, Periodic=False, KnotStyle=1)  # -> Curve, Length, Domain
intcrv_3 = Interpolate(Vertices=merge_2, Degree=3, Periodic=False, KnotStyle=1)  # -> Curve, Length, Domain
join = JoinCurves(Curves=flatten(intcrv_2.Curve), Preserve=False)
join_2 = JoinCurves(Curves=flatten([intcrv_3.Curve, intcrv.Curve]), Preserve=False)
weft = Data(join)
warp = Data(join_2)
weft_2 = ClusterOutput(weft)
warp_2 = ClusterOutput(warp)
